# Dynamo graph Core_RangeSyntax.dyn (Dynamo 2.13.0.3265)
# author: Dynamo Team
# Dynamo Core Sample

# note: Number Range and Number Sequence equivalencies
number = DoubleInput(0)
number_2 = DoubleInput(10)
number_3 = DoubleInput(2)
# note: Number Range =
# start..end..step
range = Range(start=number, end=number_2, step=number_3, lacing=Longest)
watch = Watch(range)
number_4 = DoubleInput(0)
number_5 = DoubleInput(10)
number_6 = DoubleInput(2)
# note: Number Sequence =
# start..#amount..interval
sequence = Sequence(start=number_4, amount=number_5, step=number_6, lacing=Longest)
watch_2 = Watch(sequence)
code_block = CodeBlock { 0..10..2; }
watch_3 = Watch(code_block)
code_block_2 = CodeBlock { 0..#10..2; }
watch_4 = Watch(code_block_2)
# note: start..end..step
# note: You can use range syntax in a Code Block or in a number node.  And you have several versions to choose from depending on how you want to specify the series.  All of these series can also be made with sets of library nodes.
#         start..end..step
#         start..end..#amount
#         start..#amount..interval
# start = number starting the series
# end = number ending the series
# step = difference between two consecutive numbers
# amount = how many numbers in the series
code_block_3 = CodeBlock { 0..10..2; }
# note: See also:
# http://dynamobim.org/dynamo-sequences-and-ranges/
watch_5 = Watch(code_block_3)
# note: Omitting the step value is
# equivalent to setting step=1.
# start..end  =  start..end..1
code_block_4 = CodeBlock { 0..10; }
watch_6 = Watch(code_block_4)
# note: start..end..#amount
code_block_5 = CodeBlock { 0..10..#3; }
watch_7 = Watch(code_block_5)
# note: start..#amount..interval
code_block_6 = CodeBlock { 0..#10..3; }
watch_8 = Watch(code_block_6)
integer_slider = IntegerSlider(5, range=0..10 step 1)
# note: Any of these can take variable inputs
# by just specifying an undefined name.
code_block_7 = CodeBlock(howMany=integer_slider) { 0..#howMany..3; }
watch_9 = Watch(code_block_7)
number_7 = DoubleInput(0)
number_slider = DoubleSlider(10, range=0..10 step 0.1)
number_8 = DoubleInput(2)
sequence_2 = Sequence(start=number_7, amount=number_slider, step=number_8, lacing=Longest)
# note: Use a number sequence if you care more about how many numbers are in a list and the distance between those numbers and less about where the series ends.
# Example: designing a parking lot with spaces for 12 cars.  You need to fit 12 cars, and you boundaries of the pavement are secondary.
watch_10 = Watch(sequence_2)
number_9 = DoubleInput(0)
number_10 = DoubleInput(10)
number_slider_2 = DoubleSlider(2, range=0..10 step 0.1)
# note: RANGE SYNTAX
# It's all about lists.
# Lists are a critical part of visual programming.  As you script, you will have lists of numbers, lists of circles, lists of Revit elements, and even lists of lists of things.
range_2 = Range(start=number_9, end=number_10, step=number_slider_2, lacing=Longest)
# note: Use a number range if you care more about the list start and end and less about how many items there will be.  Increasing the step value between set start and end points may result in fewer items.
# Examle: heights of steps in a staircase.  The stairs must begin and end at floor levels, and the number of steps is less important.
watch_11 = Watch(range_2)
