# Dynamo graph Geometry_Surfaces.dyn (Dynamo 2.13.0.3265)
# Dynamo Geometry

number = DoubleInput(10)
number_2 = DoubleInput(-10)
byCoordinates = Point.ByCoordinates(x=number, y=number_2)
byCoordinates_2 = Point.ByCoordinates(y=number_2)
byStartPointEndPoint = Line.ByStartPointEndPoint(startPoint=byCoordinates, endPoint=byCoordinates_2)
byCoordinates_3 = Point.ByCoordinates()
number_3 = DoubleInput(5)
byCoordinates_4 = Point.ByCoordinates(z=number_3)
number_4 = DoubleInput(10)
byCoordinates_5 = Point.ByCoordinates(x=number_4)
byThreePoints = Arc.ByThreePoints(firstPoint=byCoordinates_3, secondPoint=byCoordinates_4, thirdPoint=byCoordinates_5)
create = List.Create(item0=byStartPointEndPoint, item1=byThreePoints)
byLoft = Surface.ByLoft(crossSections=create)
area = Surface.Area(surface=byLoft)
watch = Watch(area)
byCoordinates_6 = Point.ByCoordinates(y=number_4)
number_5 = DoubleInput(5)
number_6 = DoubleInput(10)
byCoordinates_7 = Point.ByCoordinates(x=number_5, y=number_6, z=number_6)
number_7 = DoubleInput(15)
byCoordinates_8 = Point.ByCoordinates(x=number_7, y=number_7)
byThreePoints_2 = Arc.ByThreePoints(firstPoint=byCoordinates_6, secondPoint=byCoordinates_7, thirdPoint=byCoordinates_8)
number_8 = DoubleInput(-5)
number_9 = DoubleInput(5)
byCoordinates_9 = Point.ByCoordinates(x=number_8, y=number_9)
byThreePoints_3 = Arc.ByThreePoints(firstPoint=byCoordinates_3, secondPoint=byCoordinates_9, thirdPoint=byCoordinates_6)
# note: Multiple creation methods exist for most Surfaces.  Surfaces, Polysurfaces (collections of Surfaces), and Nurbs Surfaces can be create by Points, Curves, and derived from other surfaces and solids
bySweep2Rails = Surface.BySweep2Rails(path=byThreePoints_2, guideRail=byThreePoints, profile=byThreePoints_3)
create_2 = List.Create(item0=byLoft, item1=bySweep2Rails)
# note: Surfaces Joined as Polysurfaces can be evalued as a single entity
byJoinedSurfaces = PolySurface.ByJoinedSurfaces(surfaces=create_2)
area_2 = Surface.Area(surface=byJoinedSurfaces)
watch_2 = Watch(area_2)
area_3 = Surface.Area(surface=bySweep2Rails)
watch_3 = Watch(area_3)
code_block = CodeBlock { 0..1..0.1; }
# note: Edges, Points and other features can be derived from Surfaces using "Actions" appropriate to those geometries
pointAtParameter = Surface.PointAtParameter(surface=bySweep2Rails, u=code_block, v=code_block, lacing=CrossProduct)
# note: Tip:  Uncheck "Preview Upstream" in Right Click Menu to isolate Geometry in the node
byControlPoints = NurbsSurface.ByControlPoints(controlVertices=pointAtParameter)
watch_3d = Watch3D(byControlPoints)
code_block_2 = CodeBlock { 10; }
extrude = Curve.Extrude(curve=byThreePoints_2, distance=code_block_2)
