# Dynamo graph OpenXMLExport_Data To Excel.dyn (Dynamo 2.13.0.3265)
# author: Dynamo Team
# Dynamo Import Export Sample

file_path = Filename("..\..\Data\icosohedron_points.csv")
string = StringInput("helix")
number_slider = DoubleSlider(1.793, range=0..5 step 0.1)
code_block = CodeBlock(numCircles=number_slider) { 0..(360*numCircles)..10; }
cos = Math.Cos(angle=code_block, lacing=Longest)
sin = Math.Sin(angle=code_block, lacing=Longest)
code_block_2 = CodeBlock(x=code_block) { x/100; }
byCoordinates = Point.ByCoordinates(x=cos, y=sin, z=code_block_2, lacing=Longest)
code_block_3 = CodeBlock(pt=byCoordinates) { [pt.X,pt.Y,pt.Z]; }
transpose = List.Transpose(lists=code_block_3)
number = DoubleInput(0)
openXMLExportExcel = Data.OpenXMLExportExcel(filePath=file_path, sheetName=string, data=transpose, startRow=number, startColumn=number)
