# Dynamo graph Physical to Analytical for Buildings.dyn (Dynamo 2.13.0.3137)
# author: Autodesk
# Generate Structural Analytical Model based on selected physical elements. Once the model built, it can be updated based on physical model changes.

# group: Input
n1_select_physical_elements = DSModelElementsSelection()  # "1. Select physical elements"; 4 picked in the model; graph input

getCategory = Element.GetCategory(element=n1_select_physical_elements)
name = Category.Name(category=getCategory)

# group: Getting all valid elements
# Structural Framings,
# Structural Columns,
# Walls,
# Floors.
categories = Categories("OST_StructuralFraming")
name_2 = Category.Name(category=categories)
eq = name_2 == name
filterByBoolMask = List.FilterByBoolMask(list=n1_select_physical_elements, mask=eq)
categories_2 = Categories("OST_StructuralColumns")
name_3 = Category.Name(category=categories_2)
eq_2 = name_3 == name
filterByBoolMask_2 = List.FilterByBoolMask(list=n1_select_physical_elements, mask=eq_2)
join = List.Join(list0=filterByBoolMask.in, list1=filterByBoolMask_2.in)
categories_3 = Categories("OST_Walls")
name_4 = Category.Name(category=categories_3)
eq_3 = name_4 == name
filterByBoolMask_3 = List.FilterByBoolMask(list=n1_select_physical_elements, mask=eq_3)
categories_4 = Categories("OST_Floors")
name_5 = Category.Name(category=categories_4)
eq_4 = name_5 == name
filterByBoolMask_4 = List.FilterByBoolMask(list=n1_select_physical_elements, mask=eq_4)
join_2 = List.Join(list0=filterByBoolMask_3.in, list1=filterByBoolMask_4.in)

# group: Inputs
n5_inherit_properties_from = BoolSelector(true)  # "5. Inherit properties from physical elements (material, section type, cross-section rotation)"; graph input
n7_associate_with_physical = BoolSelector(true)  # "7. Associate with physical counterpart"; graph input
n6_create_analytical_opening_for = BoolSelector(true)  # "6. Create analytical opening for the selected floors and walls"; graph input

# group: Validation of Elements
# Checking if the Elements are valid for being a base for AnalyticalMembers and AnalyticalPanels. For invalid elements, the exceptionMessage shows the purpose.
isValidForAnalyticalMember = AnalyticalAutomation.RevitElements.Element.IsValidForAnalyticalMember(element=join)
isValidForAnalyticalPanel = AnalyticalAutomation.RevitElements.Element.IsValidForAnalyticalPanel(element=join_2, checkOpenings=n6_create_analytical_opening_for)

# group: Filtering
# Into valid and invalid elements
filterByBoolMask_5 = List.FilterByBoolMask(list=join, mask=isValidForAnalyticalMember.bool)
filterByBoolMask_6 = List.FilterByBoolMask(list=join_2, mask=isValidForAnalyticalPanel.bool)

# group: Creating Analytical Elements
byElement = AnalyticalAutomation.AnalyticalElements.AnalyticalMember.ByElement(element=filterByBoolMask_5.in, inheritProperties=n5_inherit_properties_from, addAssociation=n7_associate_with_physical)
byElement_2 = AnalyticalAutomation.AnalyticalElements.AnalyticalPanel.ByElement(element=filterByBoolMask_6.in, inheritProperties=n5_inherit_properties_from, addAssociation=n7_associate_with_physical, includeOpenings=n6_create_analytical_opening_for)

# group: AnalyticalMembers: output list
codeBlock = CodeBlock { false; }
allIndicesOf = List.AllIndicesOf(list=isValidForAnalyticalMember.bool, item=codeBlock)
getItemAtIndex = List.GetItemAtIndex(list=isValidForAnalyticalMember.exceptionMessage, index=allIndicesOf)
join_3 = List.Join(list0=byElement, list1=getItemAtIndex)
codeBlock_2 = CodeBlock { true; }
allIndicesOf_2 = List.AllIndicesOf(list=isValidForAnalyticalMember.bool, item=codeBlock_2)
join_4 = List.Join(list0=allIndicesOf_2, list1=allIndicesOf)
sortByKey = List.SortByKey(list=join_3, keys=join_4)
analytical_members = Watch(sortByKey.sortedList)  # graph output

# group: AnalyticalPanels: output list
code_block = CodeBlock { false; }
allIndicesOf_3 = List.AllIndicesOf(list=isValidForAnalyticalPanel.bool, item=code_block)
getItemAtIndex_2 = List.GetItemAtIndex(list=isValidForAnalyticalPanel.exceptionMessage, index=allIndicesOf_3)
join_5 = List.Join(list0=byElement_2, list1=getItemAtIndex_2)
code_block_2 = CodeBlock { true; }
allIndicesOf_4 = List.AllIndicesOf(list=isValidForAnalyticalPanel.bool, item=code_block_2)
join_6 = List.Join(list0=allIndicesOf_4, list1=allIndicesOf_3)
sortByKey_2 = List.SortByKey(list=join_5, keys=join_6)
analytical_panels_and_openings = Watch(sortByKey_2.sortedList)  # graph output

# group: Inputs
n2_1_adjust_analytical_elements = BoolSelector(true)  # "2.1. Adjust analytical elements using connectivity rules"; graph input
n2_2_tolerance_of_the_distance = DoubleInput(0.35)  # "2.2. Tolerance of the distance between analytical elements (value in project 'Length' units)"; graph input

# group: Inputs
n3_1_adjust_analytical_elements = BoolSelector(true)  # "3.1. Adjust analytical elements to nearest level"; graph input
n3_2_tolerance_of_the_distance_to = DoubleInput(0.5)  # "3.2. Tolerance of the distance to the nearest level (value in project 'Length' units)"; graph input

codeBlock_3 = CodeBlock(ElementsToElements=n2_1_adjust_analytical_elements, ToClosestLevel=n3_1_adjust_analytical_elements) { !(ElementsToElements == false && ToClosestLevel == false); }
watch = Watch(byElement)
watch_2 = Watch(byElement_2)
join_7 = List.Join(list0=watch, list1=watch_2)
flatten = List.Flatten(list=join_7)
clean = List.Clean(list=flatten)
empty = List.Empty()
if_ = RefactoredIf(test=codeBlock_3, true=clean, false=empty)

# group: AdjustmentRules
elementToElement = AnalyticalAutomation.AnalyticalAdjustment.Rules.ElementToElement(tolerance=n2_2_tolerance_of_the_distance)
allowMiddleConnectionsToSurfaces = AnalyticalAutomation.AnalyticalAdjustment.Rules.AllowMiddleConnectionsToSurfaces()
allowMiddleConnectionsToCurves = AnalyticalAutomation.AnalyticalAdjustment.Rules.AllowMiddleConnectionsToCurves()
combineRules = AnalyticalAutomation.AnalyticalAdjustment.Rules.CombineRules(rule0=elementToElement, rule1=allowMiddleConnectionsToSurfaces, rule2=allowMiddleConnectionsToCurves)
snapToClosestLevel = AnalyticalAutomation.AnalyticalAdjustment.Rules.SnapToClosestLevel(tolerance=n3_2_tolerance_of_the_distance_to)
combineRules_2 = AnalyticalAutomation.AnalyticalAdjustment.Rules.CombineRules(rule0=snapToClosestLevel, rule1=elementToElement, rule2=allowMiddleConnectionsToSurfaces, rule3=allowMiddleConnectionsToCurves)
codeBlock_4 = CodeBlock { null; }
list_create = List.Create(item0=combineRules, item1=snapToClosestLevel, item2=combineRules_2, item3=codeBlock_4)
rules_indicator = CodeBlock(ElementsToElements=n2_1_adjust_analytical_elements, ToClosestLevel=n3_1_adjust_analytical_elements)
# ---------- rules_indicator.designscript (4 lines) ----------
[(ElementsToElements == true && ToClosestLevel == false),
(ElementsToElements == false && ToClosestLevel == true),
(ElementsToElements == true && ToClosestLevel == true),
(ElementsToElements == false && ToClosestLevel == false)];
# ----------------------------------------
codeBlock_5 = CodeBlock { true; }
firstIndexOf = List.FirstIndexOf(list=rules_indicator, item=codeBlock_5)
getItemAtIndex_3 = List.GetItemAtIndex(list=list_create, index=firstIndexOf)

# group: Inputs
n4_3_third_group_of_elements = StructuralRoleComboBox("Beam")  # "4.3. Third group of elements considered for adjustment"; graph input
n4_2_second_group_of_elements = StructuralRoleComboBox("Column")  # "4.2. Second group of elements considered for adjustment"; graph input
n4_1_first_group_of_elements = StructuralRoleComboBox("Wall")  # "4.1. First group of elements considered for adjustment"; graph input

# group: AdjustmentPriorities
bringCategoryToFront = AnalyticalAutomation.AnalyticalAdjustment.Priorities.BringCategoryToFront(structuralRole=n4_3_third_group_of_elements)
bringCategoryToFront_2 = AnalyticalAutomation.AnalyticalAdjustment.Priorities.BringCategoryToFront(structuralRole=n4_2_second_group_of_elements)
bringCategoryToFront_3 = AnalyticalAutomation.AnalyticalAdjustment.Priorities.BringCategoryToFront(structuralRole=n4_1_first_group_of_elements)
combinePriorities = AnalyticalAutomation.AnalyticalAdjustment.Priorities.CombinePriorities(prioritie0=bringCategoryToFront, prioritie1=bringCategoryToFront_2, prioritie2=bringCategoryToFront_3)

# group: Adjusting Analytical Elements
adjust = AnalyticalAutomation.AnalyticalAdjustment.AnalyticalAdjustment.Adjust(analyticalElements=if_, ruleSet=getItemAtIndex_3, prioritySet=combinePriorities)
