# Dynamo graph Base Plate using sample connection type - Imperial.dyn (Dynamo 2.13.0.3137)
# author: Autodesk
# Places an imperial sample base plate connection based on the structural column type.

# group: Selects the input elements, structures them into connection nodes and takes sub nodes of 1 element.
n1_select_steel_elements = SelectStructureData()  # "1. Select steel elements"; nothing selected; graph input
fromStructure = AdvanceSteel.ConnectionAutomation.Nodes.ConnectionNode.FromStructure(objects=n1_select_steel_elements)
code_block = CodeBlock { 1; }
subNodesOfSize = AdvanceSteel.ConnectionAutomation.Nodes.ConnectionNode.SubNodesOfSize(node=fromStructure, noOfZones=code_block)

# group: Defines the zone and the index of the input element for which the connection is created.
code_block_2 = CodeBlock { 0; "End"; }
byZoneType = AdvanceSteel.ConnectionAutomation.Nodes.Filter.ByZoneType(node=subNodesOfSize, index=code_block_2.out0, zoneType=code_block_2.out1)

# group: Filters only the bottom parts of the columns.
code_block_3 = CodeBlock { 0; "Bottom"; }
byVerticalPosition = AdvanceSteel.ConnectionAutomation.Nodes.Filter.ByVerticalPosition(node=byZoneType.accepted, index=code_block_3.out0, position=code_block_3.out1)

# group: Filters the input element based on the slant angle ranging between 0 and 90 degrees.
code_block_4 = CodeBlock { 0; }
n2_1_column_slant_range_angle = DoubleInput(0)  # "2.1. Column slant range angle from"; graph input
n2_2_column_slant_range_angle_to = DoubleInput(0)  # "2.2. Column slant range angle to"; graph input
bySlantAngle = AdvanceSteel.ConnectionAutomation.Nodes.Filter.BySlantAngle(node=byVerticalPosition.accepted, index=code_block_4, rangeStart=n2_1_column_slant_range_angle, rangeEnd=n2_2_column_slant_range_angle_to)

# group: Filters the input element based on Section Type.
code_block_5 = CodeBlock { 0; }
n3_column_beam_type_to_add = StructuralDataTypes("Any | Any")  # "3. Column beam type to add connections on"; graph input
bySectionType = AdvanceSteel.ConnectionAutomation.Nodes.Filter.BySectionType(node=bySlantAngle.accepted, index=code_block_5, nameToFind=n3_column_beam_type_to_add.typeName)

# group: Build a Connection Type from a Revit file containing a library of Connection Types
string = StringInput("Base plate")
string_2 = StringInput("Sample Base Plate connection")
file_path = Filename(".\Library-imperial.rvt")
byNameAndType = AdvanceSteel.ConnectionAutomation.Nodes.ConnectionType.ByNameAndType(connectionName=string, typeName=string_2, filePath=file_path)

# group: Creates a Base Plate connection, ordering input elements by their indexes.
code_block_6 = CodeBlock { 0; }
byType = AdvanceSteel.ConnectionAutomation.Nodes.Connection.ByType(node=bySectionType.accepted, indexes=code_block_6, connectionType=byNameAndType)

# group: Displays the number of created connections per run.
code_block_7 = CodeBlock { false; }
clean = List.Clean(list=byType.Connection, preserveIndices=code_block_7)
flatten = List.Flatten(list=clean)
count = List.Count(list=flatten)
number_of_created_connections = Watch(count)  # graph output

# group: Displays the number of connection nodes where connections already existed.
code_block_8 = CodeBlock { false; }
clean_2 = List.Clean(list=byType.Existing, preserveIndices=code_block_8)
flatten_2 = List.Flatten(list=clean_2)
count_2 = List.Count(list=flatten_2)
number_of_existing_connections = Watch(count_2)  # graph output
