# Dynamo graph Bracing I splice - additional object.dyn (Dynamo 2.13.0.3137)
# author: Autodesk
# Places connections in diagonal bracing geometric situations, based on the structural column, beam, and diagonal types.

# group: Selects the input elements, structures them into connection nodes and takes sub nodes of 3 elements.
n1_select_steel_elements = SelectStructureData()  # "1. Select steel elements"; nothing selected; graph input
fromStructure = AdvanceSteel.ConnectionAutomation.Nodes.ConnectionNode.FromStructure(objects=n1_select_steel_elements)
code_block = CodeBlock { 3; }
subNodesOfSize = AdvanceSteel.ConnectionAutomation.Nodes.ConnectionNode.SubNodesOfSize(node=fromStructure, noOfZones=code_block)

# group: Defines the zones that join to create the connection. This filters inputs that connect toward the end of the elements to create a connection.
code_block_2 = CodeBlock { 1; "End"; }
byZoneType = AdvanceSteel.ConnectionAutomation.Nodes.Filter.ByZoneType(node=subNodesOfSize, index=code_block_2.out0, zoneType=code_block_2.out1)
code_block_3 = CodeBlock { 2; "End"; }
byZoneType_2 = AdvanceSteel.ConnectionAutomation.Nodes.Filter.ByZoneType(node=byZoneType.accepted, index=code_block_3.out0, zoneType=code_block_3.out1)

# group: Filters the main input element (column) by the slant angle. A range between 0 and 0 degrees depicts a vertical column. By increasing the range, it will include slanted columns as well.
code_block_4 = CodeBlock { 0; }
n2_1_column_slant_angle_range = DoubleInput(0)  # "2.1. Column slant angle range from"; graph input
n2_2_column_slant_angle_range_to = DoubleInput(0)  # "2.2. Column slant angle range to"; graph input
bySlantAngle = AdvanceSteel.ConnectionAutomation.Nodes.Filter.BySlantAngle(node=byZoneType_2.accepted, index=code_block_4, rangeStart=n2_1_column_slant_angle_range, rangeEnd=n2_2_column_slant_angle_range_to)

# group: Filters the second input element from the connection based on the slope angle.
code_block_5 = CodeBlock { 1; }
n3_1_beam_slope_angle_range_from = DoubleInput(0)  # "3.1. Beam slope angle range from"; graph input
n3_2_beam_slope_angle_range_to = DoubleInput(90)  # "3.2. Beam slope angle range to"; graph input
bySlopeAngle = AdvanceSteel.ConnectionAutomation.Nodes.Filter.BySlopeAngle(node=bySlantAngle.accepted, index=code_block_5, rangeStart=n3_1_beam_slope_angle_range_from, rangeEnd=n3_2_beam_slope_angle_range_to)

# group: Filters the second and third input elements from the connection based on the angle created between the X axis of both beams.
code_block_6 = CodeBlock { 0; 2; "X"; "X"; }
n4_1_diagonal_s_angle_with_the = DoubleInput(0)  # "4.1. Diagonal's angle with the column - range from"; graph input
n4_2_diagonal_s_angle_with_the = DoubleInput(90)  # "4.2. Diagonal's angle with the column - range to"; graph input
byAngleBetweenAxes = AdvanceSteel.ConnectionAutomation.Nodes.Filter.ByAngleBetweenAxes(node=bySlopeAngle.accepted, indexFirst=code_block_6.out0, indexSecond=code_block_6.out1, axisFirst=code_block_6.out2, axisSecond=code_block_6.out3, rangeStart=n4_1_diagonal_s_angle_with_the, rangeEnd=n4_2_diagonal_s_angle_with_the)

# group: Filters the input elements based on Section Type for each input element referenced by the index.
code_block_7 = CodeBlock { 0; }
n5_column_s_section = StructuralDataTypes("Any | Any")  # "5. Column's section"; graph input
bySectionType = AdvanceSteel.ConnectionAutomation.Nodes.Filter.BySectionType(node=byAngleBetweenAxes.accepted, index=code_block_7, nameToFind=n5_column_s_section.typeName)
code_block_8 = CodeBlock { 1; }
n6_beam_s_section = StructuralDataTypes("Any | Any")  # "6. Beam's section"; graph input
bySectionType_2 = AdvanceSteel.ConnectionAutomation.Nodes.Filter.BySectionType(node=bySectionType.accepted, index=code_block_8, nameToFind=n6_beam_s_section.typeName)
code_block_9 = CodeBlock { 2; }
n7_diagonal_s_section = StructuralDataTypes("Any | Any")  # "7. Diagonal's section"; graph input
bySectionType_3 = AdvanceSteel.ConnectionAutomation.Nodes.Filter.BySectionType(node=bySectionType_2.accepted, index=code_block_9, nameToFind=n7_diagonal_s_section.typeName)

# group: Eliminates duplicate connection nodes, such as [BeamA, BeamB] and [BeamB, BeamA].
removeDuplicates = AdvanceSteel.ConnectionAutomation.Nodes.ConnectionNode.RemoveDuplicates(nodes=bySectionType_3.accepted)

# group: Creates a Bracing I splice angle - additional object connection ordering input elements by their indexes.
code_block_10 = CodeBlock { [0,1,2]; }
n8_connection_type_to_add_in = ConnectionTypes()  # "8. Connection type to add in model"; nothing selected; graph input
byType = AdvanceSteel.ConnectionAutomation.Nodes.Connection.ByType(node=removeDuplicates, indexes=code_block_10, connectionType=n8_connection_type_to_add_in)

# group: Displays the number of created connections per run.
code_block_11 = CodeBlock { false; }
clean = List.Clean(list=byType.Connection, preserveIndices=code_block_11)
flatten = List.Flatten(list=clean)
count = List.Count(list=flatten)
number_of_created_connections = Watch(count)  # graph output

# group: Displays the number of connection nodes where connections already existed.
code_block_12 = CodeBlock { false; }
clean_2 = List.Clean(list=byType.Existing, preserveIndices=code_block_12)
flatten_2 = List.Flatten(list=clean_2)
count_2 = List.Count(list=flatten_2)
number_of_existing_connections = Watch(count_2)  # graph output
