# Dynamo graph Clip angle - beam to beam.dyn (Dynamo 2.13.0.3137)
# author: Autodesk
# Places connections in beam to beam geometric situations based on the types of the structural beams.

# group: Selects the input elements, structures them into connection nodes and takes sub nodes of 2 elements.
n1_select_steel_elements = SelectStructureData()  # "1. Select steel elements"; nothing selected; graph input
fromStructure = AdvanceSteel.ConnectionAutomation.Nodes.ConnectionNode.FromStructure(objects=n1_select_steel_elements)
code_block = CodeBlock { 2; }
subNodesOfSize = AdvanceSteel.ConnectionAutomation.Nodes.ConnectionNode.SubNodesOfSize(node=fromStructure, noOfZones=code_block)

# group: Defines the zones for which the elements are joining each other to create a connection.
code_block_2 = CodeBlock { 0; "Body"; }
byZoneType = AdvanceSteel.ConnectionAutomation.Nodes.Filter.ByZoneType(node=subNodesOfSize, index=code_block_2.out0, zoneType=code_block_2.out1)
code_block_3 = CodeBlock { 1; "End"; }
byZoneType_2 = AdvanceSteel.ConnectionAutomation.Nodes.Filter.ByZoneType(node=byZoneType.accepted, index=code_block_3.out0, zoneType=code_block_3.out1)

# group: Filters the main input elements based on the slope angle. For a range between 0 and 0 degrees, it identifies connection nodes where the main input element is horizontal. By increasing the range it will identify sloped input elements as well.
code_block_4 = CodeBlock { 0; }
slope_angle_for_main_input = DoubleInput(0)  # "Slope angle for main input element. Range start from"
slope_angle_for_main_input_2 = DoubleInput(0)  # "Slope angle for main input element. Range end to"
bySlopeAngle = AdvanceSteel.ConnectionAutomation.Nodes.Filter.BySlopeAngle(node=byZoneType_2.accepted, index=code_block_4, rangeStart=slope_angle_for_main_input, rangeEnd=slope_angle_for_main_input_2)

# group: Filters the input elements based on Section Type.
code_block_5 = CodeBlock { 0; }
n2_main_element_type = StructuralDataTypes("Any | Any")  # "2. Main element type"; graph input
bySectionType = AdvanceSteel.ConnectionAutomation.Nodes.Filter.BySectionType(node=bySlopeAngle.accepted, index=code_block_5, nameToFind=n2_main_element_type.typeName)
code_block_6 = CodeBlock { 1; }
n3_secondary_element_type = StructuralDataTypes("Any | Any")  # "3. Secondary element type"; graph input
bySectionType_2 = AdvanceSteel.ConnectionAutomation.Nodes.Filter.BySectionType(node=bySectionType.accepted, index=code_block_6, nameToFind=n3_secondary_element_type.typeName)

# group: Filters the input elements to identify the beam orientation cases supported by the clip angle connection using a filter for the angle made by the vectors of the input elements axis. E.g. the clip angle connection connects the main and second elements using straight angle cleats. The connection is not created if the cleats need to be skewed in order to connect the input elements.
code_block_7 = CodeBlock { 0; 1; "y"; "y"; 89; 90; }
byAngleBetweenAxes = AdvanceSteel.ConnectionAutomation.Nodes.Filter.ByAngleBetweenAxes(node=bySectionType_2.accepted, indexFirst=code_block_7.out0, indexSecond=code_block_7.out1, axisFirst=code_block_7.out2, axisSecond=code_block_7.out3, rangeStart=code_block_7.out4, rangeEnd=code_block_7.out5)
code_block_8 = CodeBlock { 0; 1; "y"; "y"; 0; 1; }
byAngleBetweenAxes_2 = AdvanceSteel.ConnectionAutomation.Nodes.Filter.ByAngleBetweenAxes(node=byAngleBetweenAxes.rejected, indexFirst=code_block_8.out0, indexSecond=code_block_8.out1, axisFirst=code_block_8.out2, axisSecond=code_block_8.out3, rangeStart=code_block_8.out4, rangeEnd=code_block_8.out5)
list_create = List.Create(item0=byAngleBetweenAxes.accepted, item1=byAngleBetweenAxes_2.accepted)

# group: Filters the secondary input element by the slope angle.
code_block_9 = CodeBlock { 1; }
n4_1_slope_for_secondary_element = DoubleInput(0)  # "4.1. Slope for secondary element. Range start from"; graph input
n4_2_slope_for_secondary_element = DoubleInput(90)  # "4.2. Slope for secondary element. Range ends to"; graph input
bySlopeAngle_2 = AdvanceSteel.ConnectionAutomation.Nodes.Filter.BySlopeAngle(node=list_create, index=code_block_9, rangeStart=n4_1_slope_for_secondary_element, rangeEnd=n4_2_slope_for_secondary_element)

# group: Creates a Clip Angle connection, ordering input elements by their indexes.
code_block_10 = CodeBlock { [0,1]; }
n5_connection_type_to_add_in = ConnectionTypes()  # "5. Connection type to add in model"; nothing selected; graph input
byType = AdvanceSteel.ConnectionAutomation.Nodes.Connection.ByType(node=bySlopeAngle_2.accepted, indexes=code_block_10, connectionType=n5_connection_type_to_add_in)

# group: Displays the number of created connections per run.
code_block_11 = CodeBlock { false; }
clean = List.Clean(list=byType.Connection, preserveIndices=code_block_11)
flatten = List.Flatten(list=clean)
count = List.Count(list=flatten)
number_of_created_connections = Watch(count)  # graph output

# group: Displays the number of connection nodes where connections already existed.
code_block_12 = CodeBlock { false; }
clean_2 = List.Clean(list=byType.Existing, preserveIndices=code_block_12)
flatten_2 = List.Flatten(list=clean_2)
count_2 = List.Count(list=flatten_2)
number_of_existing_connections = Watch(count_2)  # graph output
