# Dynamo graph End Plate.dyn (Dynamo 2.13.0.3137)
# author: Autodesk
# Places end plate connections in end beam geometric situations, based on the types of the structural beams.

# group: Selects the input elements, structures them into connection nodes and takes sub nodes of 1 element.
n1_select_steel_elements = SelectStructureData()  # "1. Select steel elements"; nothing selected; graph input
fromStructure = AdvanceSteel.ConnectionAutomation.Nodes.ConnectionNode.FromStructure(objects=n1_select_steel_elements)
code_block = CodeBlock { 1; }
subNodesOfSize = AdvanceSteel.ConnectionAutomation.Nodes.ConnectionNode.SubNodesOfSize(node=fromStructure, noOfZones=code_block)

# group: Filters the input elements by the zone where the connection is added and by the Section Type of the input element.
code_block_2 = CodeBlock { 0; "End"; }
byZoneType = AdvanceSteel.ConnectionAutomation.Nodes.Filter.ByZoneType(node=subNodesOfSize, index=code_block_2.out0, zoneType=code_block_2.out1)
code_block_3 = CodeBlock { 0; }
n2_beam_type_to_add_end_plate = StructuralDataTypes("Any | Any")  # "2. Beam type to add end plate connection on"; graph input
bySectionType = AdvanceSteel.ConnectionAutomation.Nodes.Filter.BySectionType(node=byZoneType.accepted, index=code_block_3, nameToFind=n2_beam_type_to_add_end_plate.typeName)

# group: Creates an End Plate connection, ordering input elements by their indexes.
code_block_4 = CodeBlock { 0; }
n3_connection_type_to_add_in = ConnectionTypes()  # "3. Connection type to add in model"; nothing selected; graph input
byType = AdvanceSteel.ConnectionAutomation.Nodes.Connection.ByType(node=bySectionType.accepted, indexes=code_block_4, connectionType=n3_connection_type_to_add_in)

# group: Displays the number of created connections per run.
code_block_5 = CodeBlock { false; }
clean = List.Clean(list=byType.Connection, preserveIndices=code_block_5)
flatten = List.Flatten(list=clean)
count = List.Count(list=flatten)
number_of_created_connections = Watch(count)  # graph output

# group: Displays the number of connection nodes where connections already existed.
code_block_6 = CodeBlock { false; }
clean_2 = List.Clean(list=byType.Existing, preserveIndices=code_block_6)
flatten_2 = List.Flatten(list=clean_2)
count_2 = List.Count(list=flatten_2)
number_of_existing_connections = Watch(count_2)  # graph output
