# Dynamo graph End plate with bolts for railing posts.dyn (Dynamo 2.13.0.3137)
# author: Autodesk
# Places railing post connections based on the types of the stringer and post beams.

# group: Selects the input elements, structures them into connection nodes and takes sub nodes of 2 elements.
n1_select_steel_elements = SelectStructureData()  # "1. Select steel elements"; nothing selected; graph input
fromStructure = AdvanceSteel.ConnectionAutomation.Nodes.ConnectionNode.FromStructure(objects=n1_select_steel_elements)
code_block = CodeBlock { 2; }
subNodesOfSize = AdvanceSteel.ConnectionAutomation.Nodes.ConnectionNode.SubNodesOfSize(node=fromStructure, noOfZones=code_block)

# group: Filters the input elements where the secondary input element will connect to the main element.
code_block_2 = CodeBlock { 1; "End"; }
byZoneType = AdvanceSteel.ConnectionAutomation.Nodes.Filter.ByZoneType(node=subNodesOfSize, index=code_block_2.out0, zoneType=code_block_2.out1)

# group: Filters the input elements where the main input element has a slope angle range betweem 0 and 90 degrees.
code_block_3 = CodeBlock { 0; }
n2_1_stringer_s_slope_angle_range = DoubleInput(0)  # "2.1. Stringer's slope angle range - from"; graph input
n2_2_stringer_s_slope_angle_range = DoubleInput(90)  # "2.2. Stringer's slope angle range - to"; graph input
bySlopeAngle = AdvanceSteel.ConnectionAutomation.Nodes.Filter.BySlopeAngle(node=byZoneType.accepted, index=code_block_3, rangeStart=n2_1_stringer_s_slope_angle_range, rangeEnd=n2_2_stringer_s_slope_angle_range)

# group: Filters the input elements where the secondary input element has a slant angle range between 0 and 90 degrees.
code_block_4 = CodeBlock { 1; }
n3_1_post_s_slant_angle_range = DoubleInput(0)  # "3.1. Post's slant angle range - from"; graph input
n3_2_post_s_slant_angle_range_to = DoubleInput(90)  # "3.2. Post's slant angle range - to"; graph input
bySlantAngle = AdvanceSteel.ConnectionAutomation.Nodes.Filter.BySlantAngle(node=bySlopeAngle.accepted, index=code_block_4, rangeStart=n3_1_post_s_slant_angle_range, rangeEnd=n3_2_post_s_slant_angle_range_to)

# group: Filters the input elements based on Section Type.
code_block_5 = CodeBlock { 0; }
n4_stringer_s_section_type = StructuralDataTypes("Any | Any")  # "4. Stringer's section type"; graph input
bySectionType = AdvanceSteel.ConnectionAutomation.Nodes.Filter.BySectionType(node=bySlantAngle.accepted, index=code_block_5, nameToFind=n4_stringer_s_section_type.typeName)
code_block_6 = CodeBlock { 1; }
n5_post_s_section_type = StructuralDataTypes("Any | Any")  # "5. Post's section type"; graph input
bySectionType_2 = AdvanceSteel.ConnectionAutomation.Nodes.Filter.BySectionType(node=bySectionType.accepted, index=code_block_6, nameToFind=n5_post_s_section_type.typeName)

# group: Eliminates duplicate connection nodes, such as [BeamA, BeamB] and [BeamB, BeamA].
removeDuplicates = AdvanceSteel.ConnectionAutomation.Nodes.ConnectionNode.RemoveDuplicates(nodes=bySectionType_2.accepted)

# group: Creates an End Plates with Bolts connection, ordering input elements by their indexes.
code_block_7 = CodeBlock { [0,1]; }
n6_connection_type_to_add_in = ConnectionTypes()  # "6. Connection type to add in model"; nothing selected; graph input
byType = AdvanceSteel.ConnectionAutomation.Nodes.Connection.ByType(node=removeDuplicates, indexes=code_block_7, connectionType=n6_connection_type_to_add_in)

# group: Displays the number of created connections per run.
code_block_8 = CodeBlock { false; }
clean = List.Clean(list=byType.Connection, preserveIndices=code_block_8)
flatten = List.Flatten(list=clean)
count = List.Count(list=flatten)
number_of_created_connections = Watch(count)  # graph output

# group: Displays the number of connection nodes where connections already existed.
code_block_9 = CodeBlock { false; }
clean_2 = List.Clean(list=byType.Existing, preserveIndices=code_block_9)
flatten_2 = List.Flatten(list=clean_2)
count_2 = List.Count(list=flatten_2)
number_of_existing_connections = Watch(count_2)  # graph output
