# Dynamo graph Flange haunch - beam to column.dyn (Dynamo 2.13.0.3137)
# author: Autodesk
# Places connections in beam to column end geometric situations, on the column flange, based on the types of the structural columns and beams.

# group: Selects the input elements, structures them into connection nodes and takes sub nodes of 2 elements.
n1_select_steel_elements = SelectStructureData()  # "1. Select steel elements"; nothing selected; graph input
fromStructure = AdvanceSteel.ConnectionAutomation.Nodes.ConnectionNode.FromStructure(objects=n1_select_steel_elements)
code_block = CodeBlock { 2; }
subNodesOfSize = AdvanceSteel.ConnectionAutomation.Nodes.ConnectionNode.SubNodesOfSize(node=fromStructure, noOfZones=code_block)

# group: Defines the zones for which the elements are joining each other to create a connection.
code_block_2 = CodeBlock { 0; "End"; }
byZoneType = AdvanceSteel.ConnectionAutomation.Nodes.Filter.ByZoneType(node=subNodesOfSize, index=code_block_2.out0, zoneType=code_block_2.out1)
code_block_3 = CodeBlock { 1; "End"; }
byZoneType_2 = AdvanceSteel.ConnectionAutomation.Nodes.Filter.ByZoneType(node=byZoneType.accepted, index=code_block_3.out0, zoneType=code_block_3.out1)

# group: Filters the input elements based on their "Y" axis to identify connection nodes where the beam is connected to the flange of the column.
code_block_4 = CodeBlock { 0; 1; "y"; "y"; 0; 0; }
byAngleBetweenAxes = AdvanceSteel.ConnectionAutomation.Nodes.Filter.ByAngleBetweenAxes(node=byZoneType_2.accepted, indexFirst=code_block_4.out0, indexSecond=code_block_4.out1, axisFirst=code_block_4.out2, axisSecond=code_block_4.out3, rangeStart=code_block_4.out4, rangeEnd=code_block_4.out5)

# group: Filters the main input element (column) by the slant angle. A range between 0 and 0 degrees depicts a vertical column. By increasing the range, it will include slanted columns as well.
code_block_5 = CodeBlock { 0; }
slant_angle_for_column_range = DoubleInput(0)  # "Slant angle for column. Range start from"
slant_angle_for_column_range_end = DoubleInput(0)  # "Slant angle for column. Range end to"
bySlantAngle = AdvanceSteel.ConnectionAutomation.Nodes.Filter.BySlantAngle(node=byAngleBetweenAxes.accepted, index=code_block_5, rangeStart=slant_angle_for_column_range, rangeEnd=slant_angle_for_column_range_end)

# group: Filters the input elements based on Section Type.
code_block_6 = CodeBlock { 0; }
n2_column_family_type = StructuralDataTypes("Any | Any")  # "2. Column family type"; graph input
bySectionType = AdvanceSteel.ConnectionAutomation.Nodes.Filter.BySectionType(node=bySlantAngle.accepted, index=code_block_6, nameToFind=n2_column_family_type.typeName)
code_block_7 = CodeBlock { 1; }
n3_rafter_family_type = StructuralDataTypes("Any | Any")  # "3. Rafter family type"; graph input
bySectionType_2 = AdvanceSteel.ConnectionAutomation.Nodes.Filter.BySectionType(node=bySectionType.accepted, index=code_block_7, nameToFind=n3_rafter_family_type.typeName)

# group: Filters the secondary input element based on the slope angle.
code_block_8 = CodeBlock { 1; }
n4_1_slope_angle_for_rafter_range = DoubleInput(0)  # "4.1. Slope angle for rafter, range start from"; graph input
n4_2_slope_angle_for_rafter_range = DoubleInput(30)  # "4.2. Slope angle for rafter, range end to"; graph input
bySlopeAngle = AdvanceSteel.ConnectionAutomation.Nodes.Filter.BySlopeAngle(node=bySectionType_2.accepted, index=code_block_8, rangeStart=n4_1_slope_angle_for_rafter_range, rangeEnd=n4_2_slope_angle_for_rafter_range)

# group: Creates a Knee of frame bolted, with haunch connection, ordering input elements by their indexes.
code_block_9 = CodeBlock { [0,1]; }
n5_connection_type_to_add_in = ConnectionTypes()  # "5. Connection type to add in model"; nothing selected; graph input
byType = AdvanceSteel.ConnectionAutomation.Nodes.Connection.ByType(node=bySlopeAngle.accepted, indexes=code_block_9, connectionType=n5_connection_type_to_add_in)

# group: Displays the number of created connections per run.
code_block_10 = CodeBlock { false; }
clean = List.Clean(list=byType.Connection, preserveIndices=code_block_10)
flatten = List.Flatten(list=clean)
count = List.Count(list=flatten)
number_of_created_connections = Watch(count)  # graph output

# group: Displays the number of connection nodes where connections already existed.
code_block_11 = CodeBlock { false; }
clean_2 = List.Clean(list=byType.Existing, preserveIndices=code_block_11)
flatten_2 = List.Flatten(list=clean_2)
count_2 = List.Count(list=flatten_2)
number_of_existing_connections = Watch(count_2)  # graph output
