# Dynamo graph Front plate splice.dyn (Dynamo 2.13.0.3137)
# author: Autodesk
# Places connections in beam end to end geometric situations based on the type of the structural beams.

# group: Selects the input elements, structures them into connection nodes and takes sub nodes of 2 elements.
n1_select_steel_elements = SelectStructureData()  # "1. Select steel elements"; nothing selected; graph input
fromStructure = AdvanceSteel.ConnectionAutomation.Nodes.ConnectionNode.FromStructure(objects=n1_select_steel_elements)
code_block = CodeBlock { 2; }
subNodesOfSize = AdvanceSteel.ConnectionAutomation.Nodes.ConnectionNode.SubNodesOfSize(node=fromStructure, noOfZones=code_block)

# group: Defines the zones for which the elements are joining each other to create a connection.
code_block_2 = CodeBlock { 0; "End"; }
byZoneType = AdvanceSteel.ConnectionAutomation.Nodes.Filter.ByZoneType(node=subNodesOfSize, index=code_block_2.out0, zoneType=code_block_2.out1)
code_block_3 = CodeBlock { 1; "End"; }
byZoneType_2 = AdvanceSteel.ConnectionAutomation.Nodes.Filter.ByZoneType(node=byZoneType.accepted, index=code_block_3.out0, zoneType=code_block_3.out1)

# group: Filters the input elements based on the angle between input elements.
code_block_4 = CodeBlock { 0; 1; }
n2_1_angle_between_axis_of_input = DoubleInput(0)  # "2.1. Angle between axis of input elements. Range start from"; graph input
n2_2_angle_between_axis_of_input = DoubleInput(180)  # "2.2. Angle between axis of input elements. Range end to"; graph input
byAngleBetweenBeams = AdvanceSteel.ConnectionAutomation.Nodes.Filter.ByAngleBetweenBeams(node=byZoneType_2.accepted, indexFirst=code_block_4.out0, indexSecond=code_block_4.out1, rangeStart=n2_1_angle_between_axis_of_input, rangeEnd=n2_2_angle_between_axis_of_input)

# group: Filters the input elements based on the type name for the main and secondary input elements
code_block_5 = CodeBlock { 0; }
n3_section_type_for_main_input = StructuralDataTypes("Any | Any")  # "3. Section type for main input element"; graph input
bySectionType = AdvanceSteel.ConnectionAutomation.Nodes.Filter.BySectionType(node=byAngleBetweenBeams.accepted, index=code_block_5, nameToFind=n3_section_type_for_main_input.typeName)
code_block_6 = CodeBlock { 1; }
n4_section_type_for_secondary = StructuralDataTypes("Any | Any")  # "4. Section type for secondary input element"; graph input
bySectionType_2 = AdvanceSteel.ConnectionAutomation.Nodes.Filter.BySectionType(node=bySectionType.accepted, index=code_block_6, nameToFind=n4_section_type_for_secondary.typeName)

# group: Eliminates duplicate connection nodes, such as [BeamA, BeamB] and [BeamB, BeamA].
removeDuplicates = AdvanceSteel.ConnectionAutomation.Nodes.ConnectionNode.RemoveDuplicates(nodes=bySectionType_2.accepted)

# group: Creates a Front Plate Splice connection, ordering input elements by their indexes.
code_block_7 = CodeBlock { [0,1]; }
n5_connection_type_to_add_in = ConnectionTypes()  # "5. Connection type to add in model"; nothing selected; graph input
byType = AdvanceSteel.ConnectionAutomation.Nodes.Connection.ByType(node=removeDuplicates, indexes=code_block_7, connectionType=n5_connection_type_to_add_in)

# group: Displays the number of created connections per run.
code_block_8 = CodeBlock { false; }
clean = List.Clean(list=byType.Connection, preserveIndices=code_block_8)
flatten = List.Flatten(list=clean)
count = List.Count(list=flatten)
number_of_created_connections = Watch(count)  # graph output

# group: Displays the number of connection nodes where connections already existed.
code_block_9 = CodeBlock { false; }
clean_2 = List.Clean(list=byType.Existing, preserveIndices=code_block_9)
flatten_2 = List.Flatten(list=clean_2)
count_2 = List.Count(list=flatten_2)
number_of_existing_connections = Watch(count_2)  # graph output
