# Dynamo graph Gable Wall End Plate.dyn (Dynamo 2.13.0.3137)
# author: Autodesk
# Places gable wall end plate connections in beam to column end geometric situations, based on the types of the structural columns and beams.

# group: Selects the input elements, structures them into connection nodes and takes sub nodes of 2 elements.
n1_select_steel_elements = SelectStructureData()  # "1. Select steel elements"; nothing selected; graph input
fromStructure = AdvanceSteel.ConnectionAutomation.Nodes.ConnectionNode.FromStructure(objects=n1_select_steel_elements)
code_block = CodeBlock { 2; }
subnodesOfSize = AdvanceSteel.ConnectionAutomation.Nodes.ConnectionNode.SubNodesOfSize(node=fromStructure, noOfZones=code_block)

# group: Filters the input elements where the main element is horizontal and enters the connection with the "body" and second element (column) is straight and enters the connection with the "end" of the element.
code_block_2 = CodeBlock { 1; 0; 0; }
bySlantAngle = AdvanceSteel.ConnectionAutomation.Nodes.Filter.BySlantAngle(node=subnodesOfSize, index=code_block_2.out0, rangeStart=code_block_2.out1, rangeEnd=code_block_2.out2)
code_block_3 = CodeBlock { 0; "Body"; }
byZoneType = AdvanceSteel.ConnectionAutomation.Nodes.Filter.ByZoneType(node=bySlantAngle.accepted, index=code_block_3.out0, zoneType=code_block_3.out1)
code_block_4 = CodeBlock { 1; "End"; }
byZoneType_2 = AdvanceSteel.ConnectionAutomation.Nodes.Filter.ByZoneType(node=byZoneType.accepted, index=code_block_4.out0, zoneType=code_block_4.out1)

# group: Custom node that filters the second element (rafter) by section shape I and C, to support creating the Gable wall end plate connection.
code_block_5 = CodeBlock { 0; }
structuralSectionShapes = StructuralSectionShapes("I-shape Parallel Flange")
bySectionShape = AdvanceSteel.ConnectionAutomation.Nodes.Filter.BySectionShape(node=byZoneType_2.accepted, index=code_block_5, shapeToFind=structuralSectionShapes)
structuralSectionShapes_2 = StructuralSectionShapes("I-shape Sloped Flange")
bySectionShape_2 = AdvanceSteel.ConnectionAutomation.Nodes.Filter.BySectionShape(node=bySectionShape.rejected, index=code_block_5, shapeToFind=structuralSectionShapes_2)
structuralSectionShapes_3 = StructuralSectionShapes("I-split Parallel Flange")
bySectionShape_3 = AdvanceSteel.ConnectionAutomation.Nodes.Filter.BySectionShape(node=bySectionShape_2.rejected, index=code_block_5, shapeToFind=structuralSectionShapes_3)
structuralSectionShapes_4 = StructuralSectionShapes("I-split Sloped Flange")
bySectionShape_4 = AdvanceSteel.ConnectionAutomation.Nodes.Filter.BySectionShape(node=bySectionShape_3.rejected, index=code_block_5, shapeToFind=structuralSectionShapes_4)
structuralSectionShapes_5 = StructuralSectionShapes("I-shape Welded")
bySectionShape_5 = AdvanceSteel.ConnectionAutomation.Nodes.Filter.BySectionShape(node=bySectionShape_4.rejected, index=code_block_5, shapeToFind=structuralSectionShapes_5)
structuralSectionShapes_6 = StructuralSectionShapes("I-shape Wide Flange")
bySectionShape_6 = AdvanceSteel.ConnectionAutomation.Nodes.Filter.BySectionShape(node=bySectionShape_5.rejected, index=code_block_5, shapeToFind=structuralSectionShapes_6)
structuralSectionShapes_7 = StructuralSectionShapes("C-channel Parallel Flange")
bySectionShape_7 = AdvanceSteel.ConnectionAutomation.Nodes.Filter.BySectionShape(node=bySectionShape_6.rejected, index=code_block_5, shapeToFind=structuralSectionShapes_7)
structuralSectionShapes_8 = StructuralSectionShapes("C Profile")
bySectionShape_8 = AdvanceSteel.ConnectionAutomation.Nodes.Filter.BySectionShape(node=bySectionShape_7.rejected, index=code_block_5, shapeToFind=structuralSectionShapes_8)
structuralSectionShapes_9 = StructuralSectionShapes("C Profile with Fold ")
bySectionShape_9 = AdvanceSteel.ConnectionAutomation.Nodes.Filter.BySectionShape(node=bySectionShape_8.rejected, index=code_block_5, shapeToFind=structuralSectionShapes_9)
structuralSectionShapes_10 = StructuralSectionShapes("C Profile with Lips")
bySectionShape_10 = AdvanceSteel.ConnectionAutomation.Nodes.Filter.BySectionShape(node=bySectionShape_9.rejected, index=code_block_5, shapeToFind=structuralSectionShapes_10)
structuralSectionShapes_11 = StructuralSectionShapes("C-channel Sloped Flange")
bySectionShape_11 = AdvanceSteel.ConnectionAutomation.Nodes.Filter.BySectionShape(node=bySectionShape_10.rejected, index=code_block_5, shapeToFind=structuralSectionShapes_11)
list_create = List.Create(item0=bySectionShape.accepted, item1=bySectionShape_2.accepted, item2=bySectionShape_3.accepted, item3=bySectionShape_4.accepted, item4=bySectionShape_5.accepted, item5=bySectionShape_6.accepted, item6=bySectionShape_7.accepted, item7=bySectionShape_8.accepted, item8=bySectionShape_9.accepted, item9=bySectionShape_10.accepted, item10=bySectionShape_11.accepted)
code_block_6 = CodeBlock(accepted=list_create) { accepted; }
code_block_7 = CodeBlock(rejected=bySectionShape_11.rejected) { rejected; }

# group: Filters the input elements based on the orientation to each other (this filters out only the connection nodes where the rafter flange is resting on top of the column) and based on the slope angle of the rafter input element.
code_block_8 = CodeBlock { 0; 1; "y"; 0; 1; }
byAngleBetweenAxes = AdvanceSteel.ConnectionAutomation.Nodes.Filter.ByAngleBetweenAxes(node=code_block_6, indexFirst=code_block_8.out0, indexSecond=code_block_8.out1, axisFirst=code_block_8.out2, axisSecond=code_block_8.out2, rangeStart=code_block_8.out3, rangeEnd=code_block_8.out4)
code_block_9 = CodeBlock { 0; }
n4_1_rafter_s_slope_range_start = DoubleInput(0)  # "4.1. Rafter's slope. Range start from"; graph input
n4_2_rafter_s_slope_range_end_to = DoubleInput(90)  # "4.2. Rafter's slope. Range end to"; graph input
bySlopeAngle = AdvanceSteel.ConnectionAutomation.Nodes.Filter.BySlopeAngle(node=byAngleBetweenAxes.accepted, index=code_block_9, rangeStart=n4_1_rafter_s_slope_range_start, rangeEnd=n4_2_rafter_s_slope_range_end_to)
code_block_10 = CodeBlock { 0; 1; "y"; 89; 90; }
byAngleBetweenAxes_2 = AdvanceSteel.ConnectionAutomation.Nodes.Filter.ByAngleBetweenAxes(node=byAngleBetweenAxes.rejected, indexFirst=code_block_10.out0, indexSecond=code_block_10.out1, axisFirst=code_block_10.out2, axisSecond=code_block_10.out2, rangeStart=code_block_10.out3, rangeEnd=code_block_10.out4)
code_block_11 = CodeBlock { 0; }
bySlopeAngle_2 = AdvanceSteel.ConnectionAutomation.Nodes.Filter.BySlopeAngle(node=byAngleBetweenAxes_2.accepted, index=code_block_11, rangeStart=n4_1_rafter_s_slope_range_start, rangeEnd=n4_2_rafter_s_slope_range_end_to)
list_create_2 = List.Create(item0=bySlopeAngle.accepted, item1=bySlopeAngle_2.accepted)

# group: Filters the input elements based on Section Type.
code_block_12 = CodeBlock { 0; }
n3_rafter_s_section_type = StructuralDataTypes("Any | Any")  # "3. Rafter's section type"; graph input
bySectionType = AdvanceSteel.ConnectionAutomation.Nodes.Filter.BySectionType(node=list_create_2, index=code_block_12, nameToFind=n3_rafter_s_section_type.typeName)
code_block_13 = CodeBlock { 1; }
n2_column_s_section_type = StructuralDataTypes("Any | Any")  # "2. Column's section type"; graph input
bySectionType_2 = AdvanceSteel.ConnectionAutomation.Nodes.Filter.BySectionType(node=bySectionType.accepted, index=code_block_13, nameToFind=n2_column_s_section_type.typeName)

# group: Creates a Gable Wall End Plate connection, ordering input elements by their indexes.
code_block_14 = CodeBlock { [0,1]; }
n5_connection_type_to_add_in = ConnectionTypes()  # "5. Connection type to add in model"; nothing selected; graph input
byType = AdvanceSteel.ConnectionAutomation.Nodes.Connection.ByType(node=bySectionType_2.accepted, indexes=code_block_14, connectionType=n5_connection_type_to_add_in)

# group: Displays the number of created connections per run.
code_block_15 = CodeBlock { false; }
clean = List.Clean(list=byType.Connection, preserveIndices=code_block_15)
flatten = List.Flatten(list=clean)
count = List.Count(list=flatten)
number_of_created_connections = Watch(count)  # graph output

# group: Displays the number of connection nodes where connections already existed.
code_block_16 = CodeBlock { false; }
clean_2 = List.Clean(list=byType.Existing, preserveIndices=code_block_16)
flatten_2 = List.Flatten(list=clean_2)
count_2 = List.Count(list=flatten_2)
number_of_existing_connections = Watch(count_2)  # graph output
