# Dynamo graph Gusset Plate at 1 Diagonal.dyn (Dynamo 2.13.0.3137)
# author: Autodesk
# Places connections on single bracing situations, based on the types of the structural beams or columns and diagonals.

# group: Selects the input elements, structures them into connection nodes and takes sub nodes of 2 elements.
n1_select_steel_elements = SelectStructureData()  # "1. Select steel elements"; nothing selected; graph input
fromStructure = AdvanceSteel.ConnectionAutomation.Nodes.ConnectionNode.FromStructure(objects=n1_select_steel_elements)
code_block = CodeBlock { 2; }
subNodesOfSize = AdvanceSteel.ConnectionAutomation.Nodes.ConnectionNode.SubNodesOfSize(node=fromStructure, noOfZones=code_block)

# group: Filters the input elements where the second element enters the connection with the "end" of the element.
code_block_2 = CodeBlock { 1; "End"; }
byZoneType = AdvanceSteel.ConnectionAutomation.Nodes.Filter.ByZoneType(node=subNodesOfSize, index=code_block_2.out0, zoneType=code_block_2.out1)

# group: Filters the diagonals based on section shapes such as angle, channel and hollow.
code_block_3 = CodeBlock { 1; }
structuralSectionShapes = StructuralSectionShapes("C Profile")
bySectionShape = AdvanceSteel.ConnectionAutomation.Nodes.Filter.BySectionShape(node=byZoneType.accepted, index=code_block_3, shapeToFind=structuralSectionShapes)
structuralSectionShapes_2 = StructuralSectionShapes("C Profile with Fold ")
bySectionShape_2 = AdvanceSteel.ConnectionAutomation.Nodes.Filter.BySectionShape(node=bySectionShape.rejected, index=code_block_3, shapeToFind=structuralSectionShapes_2)
structuralSectionShapes_3 = StructuralSectionShapes("C Profile with Lips")
bySectionShape_3 = AdvanceSteel.ConnectionAutomation.Nodes.Filter.BySectionShape(node=bySectionShape_2.rejected, index=code_block_3, shapeToFind=structuralSectionShapes_3)
structuralSectionShapes_4 = StructuralSectionShapes("C-channel Parallel Flange")
bySectionShape_4 = AdvanceSteel.ConnectionAutomation.Nodes.Filter.BySectionShape(node=bySectionShape_3.rejected, index=code_block_3, shapeToFind=structuralSectionShapes_4)
structuralSectionShapes_5 = StructuralSectionShapes("C-channel Sloped Flange")
bySectionShape_5 = AdvanceSteel.ConnectionAutomation.Nodes.Filter.BySectionShape(node=bySectionShape_4.rejected, index=code_block_3, shapeToFind=structuralSectionShapes_5)
structuralSectionShapes_6 = StructuralSectionShapes("L Profile")
bySectionShape_6 = AdvanceSteel.ConnectionAutomation.Nodes.Filter.BySectionShape(node=bySectionShape_5.rejected, index=code_block_3, shapeToFind=structuralSectionShapes_6)
structuralSectionShapes_7 = StructuralSectionShapes("L Profile with Lips")
bySectionShape_7 = AdvanceSteel.ConnectionAutomation.Nodes.Filter.BySectionShape(node=bySectionShape_6.rejected, index=code_block_3, shapeToFind=structuralSectionShapes_7)
structuralSectionShapes_8 = StructuralSectionShapes("L-angle")
bySectionShape_8 = AdvanceSteel.ConnectionAutomation.Nodes.Filter.BySectionShape(node=bySectionShape_7.rejected, index=code_block_3, shapeToFind=structuralSectionShapes_8)
structuralSectionShapes_9 = StructuralSectionShapes("Pipe Standard")
bySectionShape_9 = AdvanceSteel.ConnectionAutomation.Nodes.Filter.BySectionShape(node=bySectionShape_8.rejected, index=code_block_3, shapeToFind=structuralSectionShapes_9)
structuralSectionShapes_10 = StructuralSectionShapes("Rectangle")
bySectionShape_10 = AdvanceSteel.ConnectionAutomation.Nodes.Filter.BySectionShape(node=bySectionShape_9.rejected, index=code_block_3, shapeToFind=structuralSectionShapes_10)
structuralSectionShapes_11 = StructuralSectionShapes("Rectangle Cut")
bySectionShape_11 = AdvanceSteel.ConnectionAutomation.Nodes.Filter.BySectionShape(node=bySectionShape_10.rejected, index=code_block_3, shapeToFind=structuralSectionShapes_11)
structuralSectionShapes_12 = StructuralSectionShapes("Rectangle Parameterized")
bySectionShape_12 = AdvanceSteel.ConnectionAutomation.Nodes.Filter.BySectionShape(node=bySectionShape_11.rejected, index=code_block_3, shapeToFind=structuralSectionShapes_12)
structuralSectionShapes_13 = StructuralSectionShapes("Rectangular HSS")
bySectionShape_13 = AdvanceSteel.ConnectionAutomation.Nodes.Filter.BySectionShape(node=bySectionShape_12.rejected, index=code_block_3, shapeToFind=structuralSectionShapes_13)
structuralSectionShapes_14 = StructuralSectionShapes("Round HSS")
bySectionShape_14 = AdvanceSteel.ConnectionAutomation.Nodes.Filter.BySectionShape(node=bySectionShape_13.rejected, index=code_block_3, shapeToFind=structuralSectionShapes_14)
structuralSectionShapes_15 = StructuralSectionShapes("Round")
bySectionShape_15 = AdvanceSteel.ConnectionAutomation.Nodes.Filter.BySectionShape(node=bySectionShape_14.rejected, index=code_block_3, shapeToFind=structuralSectionShapes_15)
list_create = List.Create(item0=bySectionShape.accepted, item1=bySectionShape_2.accepted, item2=bySectionShape_3.accepted, item3=bySectionShape_4.accepted, item4=bySectionShape_5.accepted, item5=bySectionShape_6.accepted, item6=bySectionShape_7.accepted, item7=bySectionShape_8.accepted, item8=bySectionShape_9.accepted, item9=bySectionShape_10.accepted, item10=bySectionShape_11.accepted, item11=bySectionShape_12.accepted, item12=bySectionShape_13.accepted, item13=bySectionShape_14.accepted, item14=bySectionShape_15.accepted)
code_block_4 = CodeBlock(accepted=list_create) { accepted; }
code_block_5 = CodeBlock(rejected=bySectionShape_15.rejected) { rejected; }

# group: Filters the input elements for the main element based on the slope angle and based on the angle between the axes of the main and secondary input elements.
code_block_6 = CodeBlock { 0; }
n2_1_main_beam_slope_angle_range = DoubleInput(0)  # "2.1. Main beam slope angle range from"; graph input
n2_2_main_beam_slope_angle_range = DoubleInput(90)  # "2.2. Main beam slope angle range to"; graph input
bySlopeAngle = AdvanceSteel.ConnectionAutomation.Nodes.Filter.BySlopeAngle(node=code_block_4, index=code_block_6, rangeStart=n2_1_main_beam_slope_angle_range, rangeEnd=n2_2_main_beam_slope_angle_range)
code_block_7 = CodeBlock { 0; 1; }
n3_1_angle_between_elements_range = DoubleInput(0)  # "3.1. Angle between elements range from"; graph input
n3_2_angle_between_elements_range = DoubleInput(180)  # "3.2. Angle between elements range to"; graph input
byAngleBetweenBeams = AdvanceSteel.ConnectionAutomation.Nodes.Filter.ByAngleBetweenBeams(node=bySlopeAngle.accepted, indexFirst=code_block_7.out0, indexSecond=code_block_7.out1, rangeStart=n3_1_angle_between_elements_range, rangeEnd=n3_2_angle_between_elements_range)

# group: Filters the input elements based on Section Type.
code_block_8 = CodeBlock { 0; }
n4_main_beam_s_section_type = StructuralDataTypes("Any | Any")  # "4. Main beam's section type"; graph input
bySectionType = AdvanceSteel.ConnectionAutomation.Nodes.Filter.BySectionType(node=byAngleBetweenBeams.accepted, index=code_block_8, nameToFind=n4_main_beam_s_section_type.typeName)
code_block_9 = CodeBlock { 1; }
n5_diagonal_s_section_type = StructuralDataTypes("Any | Any")  # "5. Diagonal's section type"; graph input
bySectionType_2 = AdvanceSteel.ConnectionAutomation.Nodes.Filter.BySectionType(node=bySectionType.accepted, index=code_block_9, nameToFind=n5_diagonal_s_section_type.typeName)

# group: Creates a Gusset Plate at 1 Diagonal connection, ordering input elements by their indexes.
code_block_10 = CodeBlock { [0,1]; }
n6_connection_type_to_add_in = ConnectionTypes()  # "6. Connection type to add in model"; nothing selected; graph input
byType = AdvanceSteel.ConnectionAutomation.Nodes.Connection.ByType(node=bySectionType_2.accepted, indexes=code_block_10, connectionType=n6_connection_type_to_add_in)

# group: Displays the number of created connections per run.
code_block_11 = CodeBlock { false; }
clean = List.Clean(list=byType.Connection, preserveIndices=code_block_11)
flatten = List.Flatten(list=clean)
count = List.Count(list=flatten)
number_of_created_connections = Watch(count)  # graph output

# group: Displays the number of connection nodes where connections already existed.
code_block_12 = CodeBlock { false; }
clean_2 = List.Clean(list=byType.Existing, preserveIndices=code_block_12)
flatten_2 = List.Flatten(list=clean_2)
count_2 = List.Count(list=flatten_2)
number_of_existing_connections = Watch(count_2)  # graph output
