# Dynamo graph Moment connection - beam to column.dyn (Dynamo 2.13.0.3137)
# author: Autodesk
# Places connections in beam to column geometric situations, based on the types of the structural columns and beams.

# group: Selects the input elements, structures them into connection nodes and takes sub nodes of 2 elements.
n1_select_steel_elements = SelectStructureData()  # "1. Select steel elements"; nothing selected; graph input
fromStructure = AdvanceSteel.ConnectionAutomation.Nodes.ConnectionNode.FromStructure(objects=n1_select_steel_elements)
code_block = CodeBlock { 2; }
subNodesOfSize = AdvanceSteel.ConnectionAutomation.Nodes.ConnectionNode.SubNodesOfSize(node=fromStructure, noOfZones=code_block)

# group: Filters the input elements where the main input element enters the connection with the "Body" zone and the second element enters the connection with the "end" zone of element.
code_block_2 = CodeBlock { 0; "Body"; }
byZoneType = AdvanceSteel.ConnectionAutomation.Nodes.Filter.ByZoneType(node=subNodesOfSize, index=code_block_2.out0, zoneType=code_block_2.out1)
code_block_3 = CodeBlock { 1; "End"; }
byZoneType_2 = AdvanceSteel.ConnectionAutomation.Nodes.Filter.ByZoneType(node=byZoneType.accepted, index=code_block_3.out0, zoneType=code_block_3.out1)

# group: Filters elements where the slant angle of the main element and the slope angle of the second element are 0 degrees. For a slant angle ranging between 0 and 0 degrees, the input element is vertical. By increasing the range, the filter identifies slanted elements as well. When the slant angle ranges between 90 and 90 degrees, the filtered element is horizontal. For the slope angle ranging between 0 and 0 degrees, the input element is horizontal. By increasing the range, the filter identifies sloped elements as well. When the slope angle ranges between 90 and 90 degrees, the filtered element is vertical.
code_block_4 = CodeBlock { 0; }
n5_1_main_input_slant_angle_range = DoubleInput(0)  # "5.1. Main input slant angle. Range starts from"; graph input
n5_2_main_input_slant_angle_range = DoubleInput(0)  # "5.2. Main input slant angle. Range ends to"; graph input
bySlantAngle = AdvanceSteel.ConnectionAutomation.Nodes.Filter.BySlantAngle(node=byZoneType_2.accepted, index=code_block_4, rangeStart=n5_1_main_input_slant_angle_range, rangeEnd=n5_2_main_input_slant_angle_range)
code_block_5 = CodeBlock { 1; }
n6_1_second_input_slope_angle = DoubleInput(0)  # "6.1. Second input slope angle. Range starts from"; graph input
n6_2_second_input_slope_angle = DoubleInput(0)  # "6.2. Second input slope angle. Range ends to"; graph input
bySlopeAngle = AdvanceSteel.ConnectionAutomation.Nodes.Filter.BySlopeAngle(node=bySlantAngle.accepted, index=code_block_5, rangeStart=n6_1_second_input_slope_angle, rangeEnd=n6_2_second_input_slope_angle)

# group: Filters the input elements based on Section Type.
code_block_6 = CodeBlock { 0; }
n2_main_input_family_type = StructuralDataTypes("Any | Any")  # "2. Main input family type"; graph input
bySectionType = AdvanceSteel.ConnectionAutomation.Nodes.Filter.BySectionType(node=bySlopeAngle.accepted, index=code_block_6, nameToFind=n2_main_input_family_type.typeName)
code_block_7 = CodeBlock { 1; }
n3_second_element_family_type = StructuralDataTypes("Any | Any")  # "3. Second element family type"; graph input
bySectionType_2 = AdvanceSteel.ConnectionAutomation.Nodes.Filter.BySectionType(node=bySectionType.accepted, index=code_block_7, nameToFind=n3_second_element_family_type.typeName)

# group: Filters the input elements based on the angle between the axes of the main and secondary elements.
code_block_8 = CodeBlock { 0; 1; }
n4_1_angle_between_1st_and_2nd = DoubleInput(0)  # "4.1. Angle between 1st and 2nd element. Range start from"; graph input
n4_2_angle_between_1st_and_2nd = DoubleInput(90)  # "4.2. Angle between 1st and 2nd element. Range end to"; graph input
byAngleBetweenBeams = AdvanceSteel.ConnectionAutomation.Nodes.Filter.ByAngleBetweenBeams(node=bySectionType_2.accepted, indexFirst=code_block_8.out0, indexSecond=code_block_8.out1, rangeStart=n4_1_angle_between_1st_and_2nd, rangeEnd=n4_2_angle_between_1st_and_2nd)

# group: Creates a Moment End Plate connection, ordering input elements by their indexes.
code_block_9 = CodeBlock { [0,1]; }
n7_connection_type_to_add_in = ConnectionTypes()  # "7. Connection type to add in model"; nothing selected; graph input
byType = AdvanceSteel.ConnectionAutomation.Nodes.Connection.ByType(node=byAngleBetweenBeams.accepted, indexes=code_block_9, connectionType=n7_connection_type_to_add_in)

# group: Displays the number of created connections per run.
code_block_10 = CodeBlock { false; }
clean = List.Clean(list=byType.Connection, preserveIndices=code_block_10)
flatten = List.Flatten(list=clean)
count = List.Count(list=flatten)
number_of_created_connections = Watch(count)  # graph output

# group: Displays the number of connection nodes where connections already existed.
code_block_11 = CodeBlock { false; }
clean_2 = List.Clean(list=byType.Existing, preserveIndices=code_block_11)
flatten_2 = List.Flatten(list=clean_2)
count_2 = List.Count(list=flatten_2)
number_of_existing_connections = Watch(count_2)  # graph output
