# Dynamo graph Single tube brace.dyn (Dynamo 2.13.0.3137)
# author: Autodesk
# Places connections on column single bracing situations, based on the types of the structural columns and diagonals.

# group: Selects the input elements, structures them into connection nodes and takes sub nodes of 2 elements.
n1_select_steel_elements = SelectStructureData()  # "1. Select steel elements"; nothing selected; graph input
fromStructure = AdvanceSteel.ConnectionAutomation.Nodes.ConnectionNode.FromStructure(objects=n1_select_steel_elements)
code_block = CodeBlock { 2; }
subnodesOfSize = AdvanceSteel.ConnectionAutomation.Nodes.ConnectionNode.SubNodesOfSize(node=fromStructure, noOfZones=code_block)

# group: Filters the input elements where the main input element enters the connection with the "body" of the element and the second element enters the connection with the "end" of the element.
code_block_2 = CodeBlock { 0; "Body"; }
byZoneType = AdvanceSteel.ConnectionAutomation.Nodes.Filter.ByZoneType(node=subnodesOfSize, index=code_block_2.out0, zoneType=code_block_2.out1)
code_block_3 = CodeBlock { 1; "End"; }
byZoneType_2 = AdvanceSteel.ConnectionAutomation.Nodes.Filter.ByZoneType(node=byZoneType.accepted, index=code_block_3.out0, zoneType=code_block_3.out1)

# group: Filters the input elements based on the angle between the axes of the main and the secondary input elements.
code_block_4 = CodeBlock { 0; 1; "x"; }
n2_1_angle_between_first_and = DoubleInput(0)  # "2.1. Angle between first and second element. Range start from"; graph input
n2_2_angle_between_1st_and_2nd = DoubleInput(90)  # "2.2. Angle between 1st and 2nd element. range end to"; graph input
byAngleBetweenAxes = AdvanceSteel.ConnectionAutomation.Nodes.Filter.ByAngleBetweenAxes(node=byZoneType_2.accepted, indexFirst=code_block_4.out0, indexSecond=code_block_4.out1, axisFirst=code_block_4.out2, axisSecond=code_block_4.out2, rangeStart=n2_1_angle_between_first_and, rangeEnd=n2_2_angle_between_1st_and_2nd)

# group: Filters the diagonal section shape after tubular sections.
code_block_5 = CodeBlock { 1; }
structuralSectionShapes = StructuralSectionShapes("Rectangle")
bySectionShape = AdvanceSteel.ConnectionAutomation.Nodes.Filter.BySectionShape(node=byAngleBetweenAxes.accepted, index=code_block_5, shapeToFind=structuralSectionShapes)
structuralSectionShapes_2 = StructuralSectionShapes("Rectangle Cut")
bySectionShape_2 = AdvanceSteel.ConnectionAutomation.Nodes.Filter.BySectionShape(node=bySectionShape.rejected, index=code_block_5, shapeToFind=structuralSectionShapes_2)
structuralSectionShapes_3 = StructuralSectionShapes("Rectangle Parameterized")
bySectionShape_3 = AdvanceSteel.ConnectionAutomation.Nodes.Filter.BySectionShape(node=bySectionShape_2.rejected, index=code_block_5, shapeToFind=structuralSectionShapes_3)
structuralSectionShapes_4 = StructuralSectionShapes("Rectangular Bar")
bySectionShape_4 = AdvanceSteel.ConnectionAutomation.Nodes.Filter.BySectionShape(node=bySectionShape_3.rejected, index=code_block_5, shapeToFind=structuralSectionShapes_4)
structuralSectionShapes_5 = StructuralSectionShapes("Rectangular HSS")
bySectionShape_5 = AdvanceSteel.ConnectionAutomation.Nodes.Filter.BySectionShape(node=bySectionShape_4.rejected, index=code_block_5, shapeToFind=structuralSectionShapes_5)
structuralSectionShapes_6 = StructuralSectionShapes("Round")
bySectionShape_6 = AdvanceSteel.ConnectionAutomation.Nodes.Filter.BySectionShape(node=bySectionShape_5.rejected, index=code_block_5, shapeToFind=structuralSectionShapes_6)
structuralSectionShapes_7 = StructuralSectionShapes("Round Bar")
bySectionShape_7 = AdvanceSteel.ConnectionAutomation.Nodes.Filter.BySectionShape(node=bySectionShape_6.rejected, index=code_block_5, shapeToFind=structuralSectionShapes_7)
structuralSectionShapes_8 = StructuralSectionShapes("Round HSS")
bySectionShape_8 = AdvanceSteel.ConnectionAutomation.Nodes.Filter.BySectionShape(node=bySectionShape_7.rejected, index=code_block_5, shapeToFind=structuralSectionShapes_8)
structuralSectionShapes_9 = StructuralSectionShapes("Round HSS")
bySectionShape_9 = AdvanceSteel.ConnectionAutomation.Nodes.Filter.BySectionShape(node=bySectionShape_8.rejected, index=code_block_5, shapeToFind=structuralSectionShapes_9)
structuralSectionShapes_10 = StructuralSectionShapes("Pipe Standard")
bySectionShape_10 = AdvanceSteel.ConnectionAutomation.Nodes.Filter.BySectionShape(node=bySectionShape_9.rejected, index=code_block_5, shapeToFind=structuralSectionShapes_10)
list_create = List.Create(item0=bySectionShape.accepted, item1=bySectionShape_2.accepted, item2=bySectionShape_3.accepted, item3=bySectionShape_4.accepted, item4=bySectionShape_5.accepted, item5=bySectionShape_6.accepted, item6=bySectionShape_7.accepted, item7=bySectionShape_8.accepted, item8=bySectionShape_9.accepted, item9=bySectionShape_10.accepted)
code_block_6 = CodeBlock(accepted=list_create) { accepted; }
code_block_7 = CodeBlock(rejected=bySectionShape_10.rejected) { rejected; }

# group: Filters the input elements based on Section Type.
code_block_8 = CodeBlock { 0; }
n3_main_beam_s_section_type = StructuralDataTypes("Any | Any")  # "3. Main beam's section type"; graph input
bySectionType = AdvanceSteel.ConnectionAutomation.Nodes.Filter.BySectionType(node=code_block_6, index=code_block_8, nameToFind=n3_main_beam_s_section_type.typeName)
code_block_9 = CodeBlock { 1; }
n4_diagonal_s_section_type = StructuralDataTypes("Any | Any")  # "4. Diagonal's section type"; graph input
bySectionType_2 = AdvanceSteel.ConnectionAutomation.Nodes.Filter.BySectionType(node=bySectionType.accepted, index=code_block_9, nameToFind=n4_diagonal_s_section_type.typeName)

# group: Creates a Single Tube Brace Guseet at 1 Diagonal connection, ordering input elements by their indexes.
code_block_10 = CodeBlock { [0,1]; }
n5_connection_type_to_add_in = ConnectionTypes()  # "5. Connection type to add in model"; nothing selected; graph input
byType = AdvanceSteel.ConnectionAutomation.Nodes.Connection.ByType(node=bySectionType_2.accepted, indexes=code_block_10, connectionType=n5_connection_type_to_add_in)

# group: Displays the number of created connections per run.
code_block_11 = CodeBlock { false; }
clean = List.Clean(list=byType.Connection, preserveIndices=code_block_11)
flatten = List.Flatten(list=clean)
count = List.Count(list=flatten)
number_of_created_connections = Watch(count)  # graph output

# group: Displays the number of connection nodes where connections already existed.
code_block_12 = CodeBlock { false; }
clean_2 = List.Clean(list=byType.Existing, preserveIndices=code_block_12)
flatten_2 = List.Flatten(list=clean_2)
count_2 = List.Count(list=flatten_2)
number_of_existing_connections = Watch(count_2)  # graph output
