# Dynamo graph Two beams to one column web or flange by ranges.dyn (Dynamo 2.13.0.3137)
# author: Autodesk
# Places double sided connections in beam to column geometric situations, on column webs or on column flanges. Works only on connection types with attached ranges of applicability.

# group: Select input model elements
n1_select_steel_elements = SelectStructureData()  # "1. Select steel elements"; nothing selected; graph input
fromStructure = AdvanceSteel.ConnectionAutomation.Nodes.ConnectionNode.FromStructure(objects=n1_select_steel_elements)

# group: Geometric conditions
code_block = CodeBlock { 3; }
subNodesOfSize = AdvanceSteel.ConnectionAutomation.Nodes.ConnectionNode.SubNodesOfSize(node=fromStructure, noOfZones=code_block)
code_block_2 = CodeBlock { 1; }
byZoneType = AdvanceSteel.ConnectionAutomation.Nodes.Filter.ByZoneType(node=subNodesOfSize, index=code_block_2)
code_block_3 = CodeBlock { 2; }
byZoneType_2 = AdvanceSteel.ConnectionAutomation.Nodes.Filter.ByZoneType(node=byZoneType.accepted, index=code_block_3)
code_block_4 = CodeBlock { 0; }
column_slant_angle_degrees_from = DoubleInput(0)
column_slant_angle_degrees_to = DoubleInput(0)
bySlantAngle = AdvanceSteel.ConnectionAutomation.Nodes.Filter.BySlantAngle(node=byZoneType_2.accepted, index=code_block_4, rangeStart=column_slant_angle_degrees_from, rangeEnd=column_slant_angle_degrees_to)
code_block_5 = CodeBlock { 1; }
n2_1_beams_slope_angle_degrees = DoubleInput(0)  # "2.1. Beams Slope Angle (degrees) from"; graph input
n2_2_beams_slope_angle_degrees_to = DoubleInput(0)  # "2.2. Beams Slope Angle (degrees) to"; graph input
bySlopeAngle = AdvanceSteel.ConnectionAutomation.Nodes.Filter.BySlopeAngle(node=bySlantAngle.accepted, index=code_block_5, rangeStart=n2_1_beams_slope_angle_degrees, rangeEnd=n2_2_beams_slope_angle_degrees_to)
code_block_6 = CodeBlock { 2; }
bySlopeAngle_2 = AdvanceSteel.ConnectionAutomation.Nodes.Filter.BySlopeAngle(node=bySlopeAngle.accepted, index=code_block_6, rangeStart=n2_1_beams_slope_angle_degrees, rangeEnd=n2_2_beams_slope_angle_degrees_to)
beams_colinearity_tolerance = DoubleInput(90)  # "Beams colinearity tolerance (degrees)"
code_block_7 = CodeBlock(x=beams_colinearity_tolerance) { 1; 2; 180-x; 180; }
byAngleBetweenBeams = AdvanceSteel.ConnectionAutomation.Nodes.Filter.ByAngleBetweenBeams(node=bySlopeAngle_2.accepted, indexFirst=code_block_7.out0, indexSecond=code_block_7.out1, rangeStart=code_block_7.out2, rangeEnd=code_block_7.out3)
isItAWebFlangeSection = AdvanceSteel.ConnectionAutomation.Nodes.Filter.IsItAWebFlangeSection(node=byAngleBetweenBeams.accepted)

# group: Tolerance on Web or on Flange
# Note: Y axis of column means the beam is on the column's web, Z axis of column means the beam is on the column's flange. Remember to use a tolerance when comparing angles directly, the Filter.By... nodes use a tolerance of 0.0001 implicitly
n3_on_column_web_true_on_column = BoolSelector(true)  # "3. On column web=true (on column flange=false)"; graph input
code_block_8 = CodeBlock()
# ---------- code_block_8.designscript (26 lines) ----------
"# Load the Python Standard and DesignScript Libraries
import sys
import clr # imports the common language runtime (CLR) into the Dynamo Python environment so that we can call .net fucntions direclty
clr.AddReference('ProtoGeometry') # adds the Dynamo geometry engine to the CLR
from Autodesk.DesignScript.Geometry import * # imports the relevant portions of the Dynamo geometry library into the Dynamo Python environment

v1s = IN[0] # sets the v1s variable to the contents of input 0 from the Dynamo environment
v2s = IN[1] # sets the v2s variable to the ocntents of input 1 from the Dynamo environment
axs = IN[2] # sets the axs variable to the ocntents of input 2 from the Dynamo environment

angles = []
if len(v1s) > 0 and v1s[0]:
    if len(v1s) == len(v2s) and len(v1s) == len(axs):
        # generates a set for each input combination
        triples = [ [v1s[i], v2s[i], axs[i] ] for i in range(0, len(v1s)) ]

        # calculates the cross product for the axis and the each vector, then pulls the cross of the axis and the result, and gets the angle between the two
        angles360 = [Vector.AngleWithVector(Vector.Cross(triple[2], Vector.Cross(triple[0], triple[2])), Vector.Cross(triple[2], Vector.Cross(triple[1], triple[2]))) for triple in triples]

        angles180 = [360 - a if a > 180 else a for a in angles360]
        angles = [180 - a if a > 90 else a for a in angles180]
    else:
        # sets a string as the output for situations when the list inputs are mismatched
        angles = 'Lists are mismatched. Ensure an even count and rank for each input.'

OUT = angles";
# ----------------------------------------
flatten = List.Flatten(list=isItAWebFlangeSection.accepted)
code_block_9 = CodeBlock { false; }
clean = List.Clean(list=flatten, preserveIndices=code_block_9)
zones = AdvanceSteel.ConnectionAutomation.Nodes.ConnectionNode.Zones(connectionNode=clean)
code_block_10 = CodeBlock { 2; }
getItemAtIndex = List.GetItemAtIndex(list=zones@@L2, index=code_block_10)
parent = AdvanceSteel.ConnectionAutomation.Nodes.Zone.Parent(zone=getItemAtIndex)
XAxis = AdvanceSteel.ConnectionAutomation.Nodes.StructureData.XAxis(structureData=parent)
code_block_11 = CodeBlock { 0; }
getItemAtIndex_2 = List.GetItemAtIndex(list=zones@@L2, index=code_block_11)
parent_2 = AdvanceSteel.ConnectionAutomation.Nodes.Zone.Parent(zone=getItemAtIndex_2)
YAxis = AdvanceSteel.ConnectionAutomation.Nodes.StructureData.YAxis(structureData=parent_2)
XAxis_2 = AdvanceSteel.ConnectionAutomation.Nodes.StructureData.XAxis(structureData=parent_2)
python_script_from_string = PythonStringNode(script=code_block_8, IN[0]=XAxis, IN[1]=YAxis, IN[2]=XAxis_2)  # CPython3
tolerance_for_the_90_degrees = DoubleInput(0)  # "Tolerance for the 90 degrees beam to column angle in the horizontal plane"
code_block_12 = CodeBlock { "0.0001"; }
toNumber = String.ToNumber(string=code_block_12)
add = tolerance_for_the_90_degrees + toNumber
le = python_script_from_string <= add
code_block_13 = CodeBlock { 1; }
getItemAtIndex_3 = List.GetItemAtIndex(list=zones@@L2, index=code_block_13)
parent_3 = AdvanceSteel.ConnectionAutomation.Nodes.Zone.Parent(zone=getItemAtIndex_3)
XAxis_3 = AdvanceSteel.ConnectionAutomation.Nodes.StructureData.XAxis(structureData=parent_3)
python_script_from_string_2 = PythonStringNode(script=code_block_8, IN[0]=XAxis_3, IN[1]=YAxis, IN[2]=XAxis_2)  # CPython3
le_2 = python_script_from_string_2 <= add
and_ = le && le_2
code_block_14 = CodeBlock { null; }
if_ = RefactoredIf(test=and_@L1, true=clean@L1, false=code_block_14)
ZAxis = AdvanceSteel.ConnectionAutomation.Nodes.StructureData.ZAxis(structureData=parent_2)
python_script_from_string_3 = PythonStringNode(script=code_block_8, IN[0]=XAxis, IN[1]=ZAxis, IN[2]=XAxis_2)  # CPython3
le_3 = python_script_from_string_3 <= add
python_script_from_string_4 = PythonStringNode(script=code_block_8, IN[0]=XAxis_3, IN[1]=ZAxis, IN[2]=XAxis_2)  # CPython3
le_4 = python_script_from_string_4 <= add
and_2 = le_3 && le_4
if_2 = RefactoredIf(test=and_2@L1, true=clean@L1, false=code_block_14)
if_3 = RefactoredIf(test=n3_on_column_web_true_on_column, true=if_, false=if_2)

# group: Additional (optional) filtering: by section types
code_block_15 = CodeBlock { 0; }
column_section_type = StructuralDataTypes("Any | Any")
bySectionType = AdvanceSteel.ConnectionAutomation.Nodes.Filter.BySectionType(node=if_3, index=code_block_15, nameToFind=column_section_type.typeName)
code_block_16 = CodeBlock { 1; }
beam_section_type = StructuralDataTypes("Any | Any")
bySectionType_2 = AdvanceSteel.ConnectionAutomation.Nodes.Filter.BySectionType(node=bySectionType.accepted, index=code_block_16, nameToFind=beam_section_type.typeName)

# group: Cleanup for matching, totals
removeDuplicates = AdvanceSteel.ConnectionAutomation.Nodes.ConnectionNode.RemoveDuplicates(nodes=bySectionType_2.accepted)
flatten_2 = List.Flatten(list=removeDuplicates)
code_block_17 = CodeBlock { false; }
clean_2 = List.Clean(list=flatten_2, preserveIndices=code_block_17)

# group: Count total potential situations (beams to column)
code_block_18 = CodeBlock { false; }
clean_3 = List.Clean(list=clean_2, preserveIndices=code_block_18)
flatten_3 = List.Flatten(list=clean_3)
count = List.Count(list=flatten_3)
string_from_object = FromObject(obj=count)

# group: Connection family names input
# note: Use a semicolon ( ; ) to separate terms (e.g. Double side clip angle;Double side clip angle custom).
n5_connection_family_to_place = StringInput("Double side clip angle")  # "5. Connection family to place"; graph input
string = StringInput(";")
split = String.Split(string=n5_connection_family_to_place, separator0=string)

# group: Get the connection types from the library
n4_library_file_path = Filename("C:\ProgramData\Autodesk\RVT 2023\Libraries\US Imperial\Structural Connections\Steel\AISC Steel Construction Manual v15\AISC 10.1BB.rvt")  # "4. Library file path"; graph input
byName = AdvanceSteel.ConnectionAutomation.Nodes.ConnectionType.ByName(connectionName=split, filePath=n4_library_file_path)
proper_list_or_empty = CodeBlock(x=byName) { List.Flatten(List.Clean([x], false)); }

# group: Get the connection types loaded current model
code_block_19 = CodeBlock { null; }
byName_2 = AdvanceSteel.ConnectionAutomation.Nodes.ConnectionType.ByName(connectionName=split, filePath=code_block_19)
proper_list_or_empty_2 = CodeBlock(x=byName_2) { List.Flatten(List.Clean([x], false)); }

# group: Combine, with those in model taking precedence
code_block_20 = CodeBlock(x=proper_list_or_empty) { x.ConnectionName + "|" + x.TypeName; }
byKeysValues = DesignScript.Builtin.Dictionary.ByKeysValues(keys=code_block_20, values=proper_list_or_empty)
code_block_21 = CodeBlock(x=proper_list_or_empty_2) { x.ConnectionName + "|" + x.TypeName; }
setValueAtKeys = DesignScript.Builtin.Dictionary.SetValueAtKeys(dictionary=byKeysValues, keys=code_block_21, values=proper_list_or_empty_2)
values = DesignScript.Builtin.Dictionary.Values(dictionary=setValueAtKeys)

# group: Order Connection Types by name
typeName = AdvanceSteel.ConnectionAutomation.Nodes.ConnectionType.TypeName(connectionType=values)
python_script_numbers_as = Python(IN[0]=typeName)  # "Python Script: numbers as sortable strings"; CPython3
# ---------- python_script_numbers_as.python (203 lines) ----------
# (C) Copyright 2021 by Autodesk, Inc.
# Permission to use, copy, modify, and distribute this software in
# object code form for any purpose and without fee is hereby granted,
# provided that the above copyright notice appears in all copies and
# that both that copyright notice and the limited warranty and
# restricted rights notice below appear in all supporting
# documentation.
#
# AUTODESK PROVIDES THIS PROGRAM "AS IS" AND WITH ALL FAULTS.
# AUTODESK SPECIFICALLY DISCLAIMS ANY IMPLIED WARRANTY OF
# MERCHANTABILITY OR FITNESS FOR A PARTICULAR USE. AUTODESK, INC.
# DOES NOT WARRANT THAT THE OPERATION OF THE PROGRAM WILL BE
# UNINTERRUPTED OR ERROR FREE.
#
# Use, duplication, or disclosure by the U.S. Government is subject to
# restrictions set forth in FAR 52.227-19 (Commercial Computer
# Software - Restricted Rights) and DFAR 252.227-7013(c)(1)(ii)
# (Rights in Technical Data and Computer Software), as applicable.
import re
import math
import locale

dataEnteringNode = IN

# The idea is to replace the number with a string that will preserve
#   as best possible intuitive sense
#   * for the numbers magnitude add a single character at the beginning
#       indicating the number of digits in base 10, so the numbers with
#       fewer significant digits (above unit) come first. e.g:
#           * 5 will be "[1]5.0" - the 1 says it is between 1 and 10
#           * 11 will be "[2]11.0"
#           * 0.5 will be "[0]0.5" - the 0 says it between 0 and 1
#   * for negative numbers we will use different characters to leverage
#       their ordering in ASCII code, they will not be readable, but
#       the ordering will be correct
def num_sortable_str(my_num:float) -> str:
    # get the number of significant digits
    lead_digits = 0
    if my_num >= 1:
        lead_digits = 1 + int(math.log10(my_num))
    
    sortable_number = ''
    # take the first part unchanged, then add the second part by 
    #   replacing the match with the magnitude and decimal
    #   representation of the number
    if my_num >= 0:
        # why 48 + lead_digits? to make that char printable, to avoid
        #   characters that break sorting, starting at '0'
        sortable_number += '['+chr(48 + lead_digits)+']'+ str(my_num)
    else:
        # for negative numbers add a '!' sign to make them all smaller
        #   than all positives, and inverse the values so that the
        #   numbers bigger in magnitude are smaller when comparing
        #   negative numbers.
        #   why '!'? because it is generally smaller than '0', while
        #   '-' often has an issue where sorting ignores it completely
        sortable_number += '[!'+ chr(126 - lead_digits) +']'
        
        # also each individual digit needs to be inverted for negative
        #   numbers, they will no longer be readable, but that's fine
        inversed_digits = [chr(126 - ord(c)) for c in str(my_num)]
        sortable_number += ''.join(inversed_digits)
    return sortable_number

# This is the entry point, this regular expression identifies possible
#   numbers we want to interpret. If this does not match we will not
#   treat it. As regular expressions do not do arithmetic we will need
#   a function to do that logic for us, replace_numbers_for_sorting.
p = re.compile('(\d+[\']?)(([ _](\d+))?((([ _](\d+))?[/](\d+))|([{0}]\d+))?[\"]?)?([^\'"]|$)'.format(locale.localeconv()['decimal_point']))
# group  0 -> entire matched string
# group  1 -> mandatory number, either the number of feet with ' or the
#               whole or first part of fraction, or decimal
# group  4 -> optional number, whole part or numerator
# group  8 -> optional number, the numerator it it has a whole part and a
#               fraction part
# group  9 -> optional number, the denominator, whether or not is has a
#               whole part
# group 10 -> optional decimal part, with leading digits separator
# group 11 -> final character to avoid combining separate lengths

# Notes:
#   * Negative numbers are not currently considered, but the logic is
#       there. To treat negative numbers just add "-?" at the beginning
#       of the above regular expression.
#   * If feet symbol is present then inches symbol should be present,
#       otherwise they will be considered to mean different things.
#   * As separator between feet and inches, and between the whole part
#       and the fraction part of a fracionary number are accepted only
#       space ' ' and underscore '_'
#   * The decimals separator is checked against locale, but not other
#       regional settings such as digit grouping separators.

# Here we need to iterate through all numbers in the string and interpret
#   them as best possible by treating decimals, fractions with or without
#   whole part, and feet and inches.
def replace_numbers_for_sorting(s:str) -> str:
    s_consistent_spaces = re.sub('[ ]+', ' ', s)
    key = s_consistent_spaces
    offset = 0
    
    for m in p.finditer(s_consistent_spaces):
        has_feet = m[1][-1] == '\''
        has_inches = m[2] and m[2][-1] == '"'
        is_decimal = m[10] is not None
        is_fraction = m[9] is not None
        
        if has_feet:
            whole_part_idx = 4
            numerator_idx = 8
        else:
            whole_part_idx = 1
            numerator_idx = 4
        
        # if it does have whole part then the numerator is separate,
        #   otherwise it might still be a fraction and the numerator is
        #   where the whole part would be if it had one
        has_whole = m[whole_part_idx] is not None
        has_numerator = m[numerator_idx] is not None

        if is_decimal:
            # there is a decimal part, reconstruct it and parse here
            if has_whole:
                my_num = float(m[whole_part_idx] + m[10])
            else:
                my_num = float('0' + m[10])
        elif has_whole:
            my_num = float(m[whole_part_idx])
        else:
            my_num = 0.0
        
        # this spagetti code is needed so we can try and tell when there
        #   are two separate numbers from when there is a number with
        #   whole part and fraction or feets and inches
        is_one_number = not m[2] or (has_feet and has_inches) or (
            has_whole and not has_feet and ((not has_numerator) or (
                is_decimal or is_fraction)))

        fraction = 0.0
        if is_fraction:
            if has_numerator:
                fraction = float(m[numerator_idx]) / float(m[9])
            else:
                fraction = my_num / float(m[9])
                # here the whole part is missing, but we used it above as
                #   the whole part, we need to set it to zero in this case
                my_num = 0.0
        
        my_num += fraction
        sortable_number = ''
        
        # if we had a number of feet just do the conversion and add the
        #   equivalent inches to the result.
        # we also need to trim the last 2 characters
        first_num = None
        if has_feet or not is_one_number:
            if has_feet and has_inches:
                # do this only if we had inches as well
                my_num += 12.0 * float(m[1][:-1])
            else:
                # if we only had feet, then treat this number separately
                # if we don't have feet, then this is also a separate
                #   number, not the whole part of a fraction
                if has_feet:
                    first_num = 12.0 * float(m[1][:-1])
                else:
                    first_num = float(m[1])
                    if has_numerator:
                        # the numerator is actually a separate number
                        my_num = float(m[numerator_idx])
                
                sortable_number += num_sortable_str(first_num)

                # only when we had a separate feet number before our actual
                #   fraction or decimal number do we need to add another
                #   character here otherwise it will be lost by separation
                if m[2] and len(m[2]) > 1:
                    sortable_number += m[2][0]
        
        # we either had a single number or we had a previous number
        if (is_one_number ^ bool(first_num)) or (not has_feet):
            # now that we have computed the absolute value of the number we
            #   need to set its sign
            if m[0][0] == '-':
                my_num = -my_num
            
            sortable_number += num_sortable_str(my_num)
        
        # add back the final character, it could be important
        if m[11]:
            sortable_number += m[11]
        
        # we need to keep an offset because we will be searching in the
        #   string to ensure correctness, but replacing in the 'key'
        #   variable
        idx = m.start() + offset
        offset += len(sortable_number) - len(m[0])
        
        # we get the resulting string up to the current position and then
        #   replace the matched string in the remaining string only once
        key = key[:idx] + key[idx:].replace(m[0], sortable_number, 1)
    return key

OUT = [replace_numbers_for_sorting(s) for s in IN[0]]
# ----------------------------------------
sortByKey = List.SortByKey(list=values, keys=python_script_numbers_as)

# group: Filter Connection Types by name
typeName_2 = AdvanceSteel.ConnectionAutomation.Nodes.ConnectionType.TypeName(connectionType=sortByKey.sortedList)
# note: Place only connection types with names that contain these terms. Use a semicolon ( ; ) to separate terms (e.g. B to C;Flange). Leave blank to place any connection types.
n6_filter_connection_type_name = StringInput("")  # "6. Filter connection type name"; graph input
string_2 = StringInput(";")
split_2 = String.Split(string=n6_filter_connection_type_name, separator0=string_2)
contains = String.Contains(string=typeName_2@L1, searchFor=split_2)
allTrue = List.AllTrue(list=contains@L2)
filterByBoolMask = List.FilterByBoolMask(list=sortByKey.sortedList, mask=allTrue)

# group: Find applicable types
code_block_22 = CodeBlock { [0,1,2]; }
n7_select_analysis_results = AnalysisResults("Revit Member End Forces")  # "7. Select analysis results"; graph input
matchTypeByRanges = AdvanceSteel.ConnectionAutomation.Nodes.ConnectionNode.MatchTypeByRanges(node=clean_2, indexes=code_block_22, connectionTypes=filterByBoolMask.in, analysisResult=n7_select_analysis_results)

# group: Separate into ConnectionNodes and their respective List of ConnectionTypes
code_block_23 = CodeBlock { false; }
clean_4 = List.Clean(list=matchTypeByRanges.accepted, preserveIndices=code_block_23)
lastItem = List.LastItem(list=clean_4@L3)
firstItem = List.FirstItem(list=clean_4@L3)

firstItem_2 = List.FirstItem(list=lastItem@L2)

# group: Count applicable connections by type
code_block_24 = CodeBlock { false; }
clean_5 = List.Clean(list=firstItem_2, preserveIndices=code_block_24)
typeName_3 = AdvanceSteel.ConnectionAutomation.Nodes.ConnectionType.TypeName(connectionType=clean_5)
groupByKey = List.GroupByKey(list=typeName_3, keys=typeName_3)
count_2 = List.Count(list=groupByKey.groups@L2)
string_from_object_2 = FromObject(obj=count_2)

byType = AdvanceSteel.ConnectionAutomation.Nodes.Connection.ByType(node=firstItem, indexes=code_block_22, connectionType=firstItem_2)

# group: Count created connections by type
code_block_25 = CodeBlock { false; }
clean_6 = List.Clean(list=byType.Connection, preserveIndices=code_block_25)
connectionType = AdvanceSteel.ConnectionAutomation.Nodes.Connection.ConnectionType(connection=clean_6)
typeName_4 = AdvanceSteel.ConnectionAutomation.Nodes.ConnectionType.TypeName(connectionType=connectionType)
eq = typeName_4 == groupByKey.uniqueKeys@@L1
countTrue = List.CountTrue(list=eq@L2)
string_from_object_3 = FromObject(obj=countTrue)

# group: Report per connection type
string_3 = StringInput("{type_text}: {created_number} created, of {applicable_number} applicable")
string_4 = StringInput("{created_number}")
replace = String.Replace(string=string_3, searchFor=string_4, replaceWith=string_from_object_3)
string_5 = StringInput("{applicable_number}")
replace_2 = String.Replace(string=replace, searchFor=string_5, replaceWith=string_from_object_2)
string_6 = StringInput("{type_text}")
replace_3 = String.Replace(string=replace_2, searchFor=string_6, replaceWith=groupByKey.uniqueKeys)

# group: Combine lines
code_block_26 = CodeBlock { "\n"; }
join = String.Join(separator=code_block_26)  # unwired: string0, string1
code_block_27 = CodeBlock { ""; }
reduce = List.Reduce(reductor=join, seed=code_block_27, list1=replace_3)

# group: Treat input parameter errors
code_block_28 = CodeBlock { 0; }
gt = count > code_block_28
count_3 = List.Count(list=values)
gt_2 = count_3 > code_block_28
count_4 = List.Count(list=filterByBoolMask.in)
gt_3 = count_4 > code_block_28
count_5 = List.Count(list=groupByKey.uniqueKeys)
gt_4 = count_5 > code_block_28
string_7 = StringInput("No connection type was applicable anywhere. Make sure your connection types have ranges defined. Check if the library file path, the connection family to place, and the selected filtering options are correct.")
if_4 = RefactoredIf(test=gt_4, true=reduce, false=string_7)
string_8 = StringInput("The search did not find any connection types corresponding to the filtering criteria.")
if_5 = RefactoredIf(test=gt_3, true=if_4, false=string_8)
string_9 = StringInput("No connection types of the specified families were found in the library file or in the current model.")
if_6 = RefactoredIf(test=gt_2, true=if_5, false=string_9)
string_10 = StringInput("The selection does not contain any suitable situations. Please review the geometric parameters and try again.")
if_7 = RefactoredIf(test=gt, true=if_6, false=string_10)

# group: Count total created connections
code_block_29 = CodeBlock { false; }
clean_7 = List.Clean(list=byType.Connection, preserveIndices=code_block_29)
flatten_4 = List.Flatten(list=clean_7)
count_6 = List.Count(list=flatten_4)
string_from_object_4 = FromObject(obj=count_6)

# group: Count total connections that existed
code_block_30 = CodeBlock { false; }
clean_8 = List.Clean(list=byType.Existing, preserveIndices=code_block_30)
flatten_5 = List.Flatten(list=clean_8)
count_7 = List.Count(list=flatten_5)
string_from_object_5 = FromObject(obj=count_7)

# group: Count total applicable connections (according to ranges)
code_block_31 = CodeBlock { false; }
clean_9 = List.Clean(list=firstItem, preserveIndices=code_block_31)
flatten_6 = List.Flatten(list=clean_9)
count_8 = List.Count(list=flatten_6)
string_from_object_6 = FromObject(obj=count_8)

# group: Create totals report
string_11 = StringInput("\n\nTotal: {created_number} created, {existing_number} existed, from {applicable_number} applicable, out of {situations_number} potential situations.")
string_12 = StringInput("{created_number}")
replace_4 = String.Replace(string=string_11, searchFor=string_12, replaceWith=string_from_object_4)
string_13 = StringInput("{existing_number}")
replace_5 = String.Replace(string=replace_4, searchFor=string_13, replaceWith=string_from_object_5)
string_14 = StringInput("{applicable_number}")
replace_6 = String.Replace(string=replace_5, searchFor=string_14, replaceWith=string_from_object_6)
string_15 = StringInput("{situations_number}")
replace_7 = String.Replace(string=replace_6, searchFor=string_15, replaceWith=string_from_object)

# group: Combine complete output
string_16 = StringInput("Rundown:\n")
concat = String.Concat(string0=string_16, string1=if_7, string2=replace_7)
summary_report = Watch(concat)  # graph output

# group: Validate the not applicable
code_block_32 = CodeBlock { false; }
clean_10 = List.Clean(list=matchTypeByRanges.rejected, preserveIndices=code_block_32)
validate = AdvanceSteel.ConnectionAutomation.Nodes.ConnectionType.Validate(node=clean_10, uniqueIndexes=code_block_22, connectionTypes=filterByBoolMask.in, analysisResult=n7_select_analysis_results)

# group: Get input member info
zones_2 = AdvanceSteel.ConnectionAutomation.Nodes.ConnectionNode.Zones(connectionNode=clean_10)
parent_4 = AdvanceSteel.ConnectionAutomation.Nodes.Zone.Parent(zone=zones_2)
code_block_33 = CodeBlock(x=parent_4) { x.SectionProfile + "|" + x.SectionType; }
revitHandle = AdvanceSteel.ConnectionAutomation.Nodes.StructureData.RevitHandle(structureData=parent_4)

# group: Format situation info
string_17 = StringInput("{types_text} ({element_ids_numbers})")
string_18 = StringInput("{types_text}")
code_block_34 = CodeBlock { ", "; }
join_2 = String.Join(separator=code_block_34@L2, string0=code_block_33)
replace_8 = String.Replace(string=string_17, searchFor=string_18, replaceWith=join_2)
string_19 = StringInput("{element_ids_numbers}")
join_3 = String.Join(separator=code_block_34@L2, string0=revitHandle)
replace_9 = String.Replace(string=replace_8, searchFor=string_19, replaceWith=join_3)
flatten_7 = List.Flatten(list=replace_9)

# group: Keep only failed conditions
components = DesignScript.Builtin.Dictionary.Components(dictionary=validate.additionalInfo)
components_2 = DesignScript.Builtin.Dictionary.Components(dictionary=components.values)
code_block_35 = CodeBlock { "kNotPassed"; }
startsWith = String.StartsWith(string=components_2.values, searchFor=code_block_35)
filterByBoolMask_2 = List.FilterByBoolMask(list=components_2.values, mask=startsWith)
byKeysValues_2 = DesignScript.Builtin.Dictionary.ByKeysValues(keys=components_2.keys@L2, values=filterByBoolMask_2.in@L3)
byKeysValues_3 = DesignScript.Builtin.Dictionary.ByKeysValues(keys=components.keys@L1, values=byKeysValues_2@L1)

# group: Aggregate information
# Combine situation information and connection type names with ranges validation
code_block_36 = CodeBlock(x=filterByBoolMask.in) { x.ConnectionName + "|" + x.TypeName; }
byKeysValues_4 = DesignScript.Builtin.Dictionary.ByKeysValues(keys=code_block_36, values=byKeysValues_3@L2)
byKeysValues_5 = DesignScript.Builtin.Dictionary.ByKeysValues(keys=flatten_7, values=byKeysValues_4)
